# Grasshopper definition 01_planning_foc.ghx (Grasshopper 1.0.7)
# plug-ins: Bifocals

building_element = ValueList({"Short": 0.5, "Long": 1}, selected=["Short", "Long"])
brep = Brep([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])
info = Info()  # -> info
#   port info: Environment info.
# ---------- info: Python ----------
"""
Displays information about the active COMPAS environment.
"""
import compas_bootstrapper
from ghpythonlib.componentbase import executingcomponent as component

import compas
import compas_fab


class CompasInfo(component):
    def RunScript(self):
        self.Message = 'COMPAS v{}'.format(compas.__version__)
        info = 'COMPAS Version: {}\nEnvironment: {}\nCOMPAS FAB Version:{}'
        return (info.format(compas.__version__, compas_bootstrapper.ENVIRONMENT_NAME,compas_fab.__version__))
# ---------- end info ----------

# ----
# Load Robot
connect = BooleanToggle(True)
# Package Version: COMPAS Version: 1.17.4
# COMPAS FAB Version:0.27.0
ros_connect = ROSConnect(connect=connect)  # -> ros_client, is_connected; inputs port: Int32, connect: Boolean
#   port ip: The ip address ROS. Defaults to 127.0.0.1.
#   port port: The port of ROS. Defaults to 9090.
#   port connect: If True, connects to ROS. If False, disconnects from ROS. Defaults to False.
#   port ros_client: The ROS client.
#   port is_connected: True if connection established.
# ---------- ros_connect: Python ----------
"""
Connect or disconnect to ROS.

COMPAS FAB v0.27.0
"""
from ghpythonlib.componentbase import executingcomponent as component
from scriptcontext import sticky as st

from compas_fab.backends import RosClient
from compas_fab.ghpython.components import create_id


class ROSConnect(component):
    def RunScript(self, ip, port, connect):
        ros_client = None

        ip = ip or '127.0.0.1'
        port = port or 9090

        key = create_id(self, 'ros_client')
        ros_client = st.get(key, None)

        if ros_client:
            st[key].close()
        if connect:
            st[key] = RosClient(ip, port)
            st[key].run(5)

        ros_client = st.get(key, None)
        is_connected = ros_client.is_connected if ros_client else False
        return (ros_client, is_connected)
# ---------- end ros_connect ----------
# Labeled Robots
load_robot = BooleanToggle(True)
ros_robot = ROSRobot(ros_client=ros_connect.ros_client, load=load_robot)  # -> robot; inputs load: Boolean
#   port ros_client: The ROS client.
#   port load: If True, loads the robot from ROS. Defaults to False.
# ---------- ros_robot: Python ----------
"""
Load robot directly from ROS.

COMPAS FAB v0.27.0
"""
from compas_ghpython.artists import RobotModelArtist
from ghpythonlib.componentbase import executingcomponent as component
from scriptcontext import sticky as st

from compas_fab.ghpython.components import create_id


class ROSRobot(component):
    def RunScript(self, ros_client, load):
        key = create_id(self, 'robot')

        if ros_client and ros_client.is_connected and load:
            # Load URDF from ROS
            st[key] = ros_client.load_robot(load_geometry=True, precision='12f')
            st[key].artist = RobotModelArtist(st[key].model)

        robot = st.get(key, None)
        if robot:  # client sometimes need to be restarted, without needing to reload geometry
            robot.client = ros_client
        return robot
# ---------- end ros_robot ----------

# ----
# Tool Attachment
# Tool Robot A
number_slider = Slider(0.153, range=0..1)
# COLLISIONS
number_slider_2 = Slider(0.012, range=0..0.1)
subtraction = Subtraction(A=number_slider, B=number_slider_2)
pt = ConstructPoint(XCoordinate=0, YCoordinate=0, ZCoordinate=subtraction)
xy_plane = XYPlane(Origin=pt)
rad = Radians(Degrees=Slider(45, range=0..83))
gripper_bounding_box_mesh = Mesh(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)
gripper_meshes = Mesh([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])
prot = RotatePlane(Plane=xy_plane, Angle=rad)
mjoin = MeshJoin(Meshes=gripper_meshes)
tool = AttachedTool(robot=ros_robot, visual_mesh=mjoin, collision_mesh=gripper_bounding_box_mesh, tcf_plane=prot)  # -> robot; inputs visual_mesh: Mesh, collision_mesh: Mesh
#   port visual_mesh: A visual mesh for the tool.
#   port collision_mesh: A collision mesh for the tool.
#   port tcf_plane: The frame of the tool in tool0 frame.
#   port group: The planning group to which the tool should be attached.
# ---------- tool: Python ----------
"""
Attach a tool to the robot.

COMPAS FAB v0.27.0
"""
from ghpythonlib.componentbase import executingcomponent as component
from compas_rhino.conversions import RhinoMesh
from compas_rhino.conversions import plane_to_compas_frame

from compas.geometry import Frame
from compas_fab.robots import Tool


class AttachToolComponent(component):
    def RunScript(self, robot, visual_mesh, collision_mesh, tcf_plane, group):
        if robot and robot.client and robot.client.is_connected and visual_mesh:
            if not collision_mesh:
                collision_mesh = visual_mesh

            c_visual_mesh = RhinoMesh.from_geometry(visual_mesh).to_compas()
            c_collision_mesh = RhinoMesh.from_geometry(collision_mesh).to_compas()

            if not tcf_plane:
                frame = Frame.worldXY()
            else:
                frame = plane_to_compas_frame(tcf_plane)
                print frame.quaternion
            tool = Tool(c_visual_mesh, frame, c_collision_mesh)

            robot.attach_tool(tool, group)

        return robot
# ---------- end tool ----------

your_version = Panel(info)

list_item = ListItem(List=brep, Index=0, Wrap=True)  # -> Item, Item1, Item2, Item3, Item4, Item5, Item6, Item7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
append = BooleanToggle(False)
remove = BooleanToggle(False)
add = BooleanToggle(True)
# ELEMENT PLANNING
scene = PlanningScene(robot=tool)  # -> scene
#   port scene: A planning scene.
# ---------- scene: Python ----------
"""
Create a planning scene.

COMPAS FAB v0.27.0
"""
from ghpythonlib.componentbase import executingcomponent as component
from scriptcontext import sticky as st

from compas_fab.ghpython.components import create_id
from compas_fab.robots import PlanningScene


class PlanningSceneComponent(component):
    def RunScript(self, robot):
        key = create_id(self, 'planning_scene')
        if robot:
            st[key] = PlanningScene(robot)
        return st.get(key, None)
# ---------- end scene ----------
mesh_join = MeshJoin(Meshes=[list_item.Item9, list_item.Item10, list_item.Item8, list_item.Item7, list_item.Item6, list_item.Item5, list_item.Item3, list_item.Item4, list_item.Item2, list_item.Item1, list_item.Item, list_item.Item11])
cm = CollisionMesh(scene=scene, mesh=mesh_join, identifier="beams", add=add, append=append, remove=remove)  # -> ok; inputs mesh: Mesh, add: Boolean, append: Boolean, remove: Boolean
#   port scene: The planning scene.
#   port mesh: A collision mesh.
#   port identifier: The identifier of the collision mesh.
#   port add: If True, adds the collision mesh to the planning scene.
#   port append: If True, appends the collision mesh to the planning scene.
#   port remove: If True, removes the collision mesh from the planning scene.
#   port ok: True if the operation was successfully performed.
# ---------- cm: Python ----------
"""
Add or remove a collision mesh from the planning scene.

COMPAS FAB v0.27.0
"""
from compas_rhino.geometry import RhinoMesh
from ghpythonlib.componentbase import executingcomponent as component

from compas_fab.robots import CollisionMesh


class CollisionMeshComponent(component):
    def RunScript(self, scene, M, name, add, append, remove):
        ok = False
        self.Message = ""

        if (add and append) or (append and remove) or (add and remove):
            self.Message = "Use only one operation at a time\n(add, append or remove)"
            raise Exception(self.Message)

        if scene and M and name:
            mesh = RhinoMesh.from_geometry(M).to_compas()
            collision_mesh = CollisionMesh(mesh, name)
            if add:
                scene.add_collision_mesh(collision_mesh)
                self.Message = "Added"
                ok = True
            if append:
                scene.append_collision_mesh(collision_mesh)
                self.Message = "Appended"
                ok = True
            if remove:
                scene.remove_collision_mesh(name)
                self.Message = "Removed"
                ok = True
        return ok
# ---------- end cm ----------

# ----
# ROBOT BASE
brep_2 = Brep(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)
brep_3 = Brep(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)
mesh_join_2 = MeshJoin(Meshes=brep_2)
scene_2 = PlanningScene(robot=tool)  # -> scene; same code as scene
cm_2 = CollisionMesh(scene=scene_2, mesh=mesh_join_2, identifier="Table", add=Toggle(True), append=Toggle(False), remove=Button())  # -> ok; inputs mesh: Mesh, add: Boolean, append: Boolean, remove: Boolean; same code as cm
panel = Panel(cm_2)

robot = Data(tool)

# ---- group: set config
# Configuration A
a1 = Slider(0, range=-360..360)
a2 = Slider(0, range=-360..360)
a4 = Slider(0, range=-360..360)
a5 = Slider(0, range=-360..360)
a3 = Slider(0, range=-360..360)
a6 = Slider(0, range=-360..360)
config = PythonScript(vals=[a1, a2, a3, a4, a5, a6])  # -> config; inputs vals: list
# ---------- config: Python ----------
import math
from compas.robots import Configuration

config = Configuration.from_revolute_values([math.radians(a) for a in vals])
print config
# ---------- end config ----------

# ----
list_length = ListLength(List=brep)
volume = Volume(Geometry=brep)  # -> Volume, Centroid
series = Series(Start=0, Step=1, Count=list_length)

# ----
# PICK UP A
panel_2 = Panel("-953.51")
construct_point = ConstructPoint(
    XCoordinate=expr("x/1000", panel_2),
    YCoordinate=expr("x/1000", "-3.09"),
    ZCoordinate=expr("x/1000 - 0.153 + 0.012", "182.27"))
point = Point(construct_point)
xy_plane_2 = XYPlane(Origin=point)
rotate_plane = RotatePlane(Plane=xy_plane_2, Angle="-0.5*pi")
flip_plane = FlipPlane(Plane=rotate_plane, ReverseX=Toggle(True), ReverseY=Toggle(True), SwapAxes=Toggle(True))

geometry = Geometry([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])
mesh_brep = MeshBrep(
    Brep=geometry,
    Settings={GridMaxCount=0, GridMinCount=16, JaggedSeams=False, MaxEdgeLength=0, MinEdgeLength=0.0001, MinTolerance=0, Refine=True, RefineAngle=0, RelativeTolerance=0.65, SimplePlanes=True, Tolerance=0})
mesh_join_3 = MeshJoin(Meshes=mesh_brep)
scene_3 = PlanningScene(robot=tool)  # -> scene; same code as scene
cm_3 = CollisionMesh(scene=scene_3, mesh=mesh_join_3, identifier="booth", add=Toggle(True), append=Toggle(False), remove=Button())  # -> ok; inputs mesh: Mesh, add: Boolean, append: Boolean, remove: Boolean; same code as cm
panel_3 = Panel(cm_3)

text_tag = TextTag(Location=volume.Centroid, Text=series)
unit_z = UnitZ(Factor=Slider(0.024, range=0..0.1))
number_slider_3 = Slider(14, range=0..100)
move = Move(Geometry=flip_plane, Motion=unit_z)  # -> Geometry, Transform
vec = VectorXYZ(XComponent=0, YComponent=0, ZComponent=Slider(0.15, range=0..1))  # -> Vector, Length

# ----
# Place A
list_item_2 = ListItem(List=brep, Index=number_slider_3, Wrap=True)
deconstruct_brep = DeconstructBrep(Brep=list_item_2)  # -> Faces, Edges, Vertices
length = Length(Curve=deconstruct_brep.Edges)
sort_list = SortList(Keys=length, ValuesValuesA=deconstruct_brep.Edges)  # -> Keys, ValuesValuesA
ghpython_script = GhPythonScript(mesh=deconstruct_brep.Faces, lengths=building_element, edges=sort_list.ValuesValuesA)  # -> plane, element_length, move; inputs mesh: list of Mesh, lengths: list, edges: list of Line
# ---------- ghpython_script: Python ----------
import Rhino.Geometry as rg

centroids = []
area = []
indices = []

for i,m in enumerate(mesh):
    
    indices.append(i)
    centroid = rg.Point3d(0,0,0)
    for v in m.Vertices:
        centroid += rg.Point3d(v.X, v.Y, v.Z)

    centroids.append(centroid/len(m.Vertices))
    area.append(rg.AreaMassProperties.Compute(m).Area)

zipped_lists = zip(area, centroid, indices)
sorted_pairs = sorted(zipped_lists)

sorted_area, sorted_centroid, indices = zip(*sorted_pairs)

pt1 = centroids[indices[0]]
pt2 = centroids[indices[1]]
axis = rg.Line(rg.Point3d(pt1.X, pt1.Y, pt1.Z), rg.Point3d(pt2.X, pt2.Y, pt2.Z))

if axis.Length > lengths[0]+0.01:
    element_length = lengths[1]
else:
    element_length = lengths[0]

move = element_length * 0.25

origin = axis.PointAt(0.5)
xaxis = edges[6].PointAt(1) - edges[6].PointAt(0)
yaxis = edges[-1].PointAt(1) - edges[-1].PointAt(0)

plane = rg.Plane(origin, xaxis, yaxis)
# ---------- end ghpython_script ----------
list_item_3 = ListItem(List=sort_list.ValuesValuesA, Index="-1", Wrap=True)

# ----
# ATTACHED ELEMENTS
# A
section_size = Slider(0.024, range=0..0.1)
# ////////////////////////// PROCESS ////////////////////////// PROCESS ////////////////////////// PROCESS ////////////////////////// PROCESS ////////////////////////// PROCESS ////////////////////////// PROCESS ////////////////////////// PROCESS ////////////////////////// PROCESS ////////////////////////// PROCESS ////////////////////////// PROCESS //////////////////////////
number_slider_4 = Slider(0.024, range=0..0.1)
addition = Addition(A=subtraction, B=number_slider_4)
unit_z_2 = UnitZ(Factor=expr("-x", number_slider_4))
construct_point_2 = ConstructPoint(XCoordinate=0, YCoordinate=0, ZCoordinate=addition)
building_block = CenterBox(
    Base=PlaneXY(0, 0, 0),
    X=expr("0.5*x", section_size),
    Y=expr("0.5*x", ghpython_script.element_length),
    Z=expr("0.5*x", section_size))
move_2 = Move(Geometry=building_block, Motion=construct_point_2)  # -> Geometry, Transform
move_3 = Move(Geometry=move_2.Geometry, Motion=unit_z_2)  # -> Geometry, Transform

value_list = ValueList({"One Side": -1, "Center": 0, "Other Side": 1}, selected="Other Side")

# ----
# Adjustment for different pick
multiplication = Multiplication(A=value_list, B=ghpython_script.move)
amplitude = Amplitude(Vector=list_item_3, Amplitude=multiplication)
move_4 = Move(Geometry=ghpython_script.plane, Motion=amplitude)  # -> Geometry, Transform

unit_y = UnitY(Factor=1)
amplitude_2 = Amplitude(Vector=unit_y, Amplitude=multiplication)
move_5 = Move(Geometry=move.Geometry, Motion=amplitude_2)  # -> Geometry, Transform

move_6 = Move(Geometry=move_5.Geometry, Motion=vec.Vector)  # -> Geometry, Transform
inverse_kinematics = InverseKinematics(robot=robot, plane=move_6.Geometry)  # -> configuration
#   port plane: The plane or frame to calculate the inverse kinematic for.
#   port start_configuration: If passed, calculates the inverse such that the joint positions differ the least from the start_configuration. Defaults to the zero configuration.
#   port group: The planning group used for calculation. Defaults to the robot's main planning group.
#   port configuration: The planning group's configuration.
# ---------- inverse_kinematics: Python ----------
"""
Calculate the robot's inverse kinematic for a given plane.

COMPAS FAB v0.27.0
"""
from compas_rhino.conversions import RhinoPlane
from ghpythonlib.componentbase import executingcomponent as component


class InverseKinematics(component):
    def RunScript(self, robot, plane, start_configuration, group):
        configuration = None
        if robot and robot.client and robot.client.is_connected and plane:
            frame = RhinoPlane.from_geometry(plane).to_compas_frame()
            configuration = robot.inverse_kinematics(frame, start_configuration, group)
        return configuration
# ---------- end inverse_kinematics ----------
pickapproach_config_robota = Data(inverse_kinematics)
robot_visualize = RobotVisualize(robot=ros_robot, configuration=pickapproach_config_robota)  # -> visual, collision, collision_meshes, attached_meshes, frames, base_frame, ee_frame; inputs show_visual: Boolean, show_collision: Boolean, show_frames: Boolean, show_base_frame: Boolean, show_end_effector_frame: Boolean, show_cm: Boolean, show_acm: Boolean
#   port group: The planning group used for end-effector and base visualization.
#   port configuration: The robot's full configuration.
#   port show_visual: Whether or not to show the robot's visual meshes.
#   port show_collision: Whether or not to show the robot's collision meshes.
#   port show_frames: Whether or not to show the robot's joint frames.
#   port show_base_frame: Whether or not to show the robot's base frame.
#   port show_end_effector_frame: Whether or not to show the robot's end-effector frame.
#   port show_cm: Whether or not to show the collision meshes (if any).
#   port show_acm: Whether or not to show the attached collision meshes (if any).
#   port visual: Rhino meshes of the robot's visual geometry (if any).
#   port collision: Rhino meshes of the robot's collision geometry (if any).
#   port collision_meshes: Rhino meshes of the scene's collision meshes (if any).
#   port attached_meshes: Rhino meshes of the scene's attached collision meshes (if any).
#   port frames: The robot's joint frames as Rhino planes (if any).
#   port base_frame: The robot's base frame as a Rhino plane (if any).
#   port ee_frame: The robot's end-effector frame as a Rhino plane (if any).
# ---------- robot_visualize: Python ----------
"""
Visualizes the robot.

COMPAS FAB v0.27.0
"""
from compas.artists import Artist
from compas.geometry import Frame
from compas.geometry import Transformation
from compas_fab.robots import PlanningScene
from ghpythonlib.componentbase import executingcomponent as component


class RobotVisualize(component):
    def RunScript(
        self,
        robot,
        group,
        configuration,
        show_visual,
        show_collision,
        show_frames,
        show_base_frame,
        show_end_effector_frame,
        show_cm,
        show_acm,
    ):

        visual = None
        collision = None
        collision_meshes = None
        attached_meshes = None
        frames = None
        base_frame = None
        ee_frame = None

        if robot:
            show_visual = True if show_visual is None else show_visual
            show_cm = True if show_cm is None else show_cm
            show_acm = True if show_acm is None else show_acm
            configuration = configuration or robot.zero_configuration()

            robot.update(configuration, visual=show_visual, collision=show_collision)
            compas_frames = robot.transformed_frames(configuration, group)

            if show_visual:
                visual = robot.artist.draw_visual()

            if show_collision:
                collision = robot.artist.draw_collision()

            if show_base_frame:
                base_compas_frame = compas_frames[0]
                artist = Artist(base_compas_frame)
                base_frame = artist.draw()

            if show_end_effector_frame:
                ee_compas_frame = robot.forward_kinematics(
                    configuration, group, options=dict(solver="model")
                )
                artist = Artist(ee_compas_frame)
                ee_frame = artist.draw()

            if show_frames:
                frames = []
                for compas_frame in compas_frames[1:]:
                    artist = Artist(compas_frame)
                    frame = artist.draw()
                    frames.append(frame)

            if show_cm or show_acm:
                scene = PlanningScene(robot)
                scene = robot.client.get_planning_scene()

                collision_meshes = []
                attached_meshes = []

                if show_cm:
                    for co in scene.world.collision_objects:
                        header = co.header
                        frame_id = header.frame_id
                        cms = co.to_collision_meshes()

                        for cm in cms:
                            if cm.frame != Frame.worldXY():
                                t = Transformation.from_frame(cm.frame)
                                mesh = cm.mesh.transformed(t)
                            else:
                                mesh = cm.mesh

                            collision_meshes.append(Artist(mesh).draw())

                if show_acm:
                    for aco in scene.robot_state.attached_collision_objects:
                        for acm in aco.to_attached_collision_meshes():
                            frame_id = aco.object["header"]["frame_id"]
                            frame = robot.forward_kinematics(
                                configuration, options=dict(link=frame_id)
                            )
                            t = Transformation.from_frame(frame)

                            # Local CM frame
                            if (
                                acm.collision_mesh.frame
                                and acm.collision_mesh.frame != Frame.worldXY()
                            ):
                                t = t * Transformation.from_frame(
                                    acm.collision_mesh.frame
                                )

                            mesh = acm.collision_mesh.mesh.transformed(t)

                            attached_meshes.append(Artist(mesh).draw())

        return (
            visual,
            collision,
            collision_meshes,
            attached_meshes,
            frames,
            base_frame,
            ee_frame,
        )
# ---------- end robot_visualize ----------

# ----
# robotA PLACE Approach Config
# Check if placing plane is okay!
approaching_vector = ValueList({"Plane Z Axis": 0, "Plane X Axis": 1, "Plane Y Axis": 2, "World Z Axis": 3, "World X Axis": 4, "World Y Axis": 5}, selected="Plane Z Axis")
plane_orienatation = ValueList({"x , y": 0, "-x , y": 1, "z , y": 2, "-z , y": 3}, selected="-x , y")
ghpython_script_2 = GhPythonScript(
    plane=move_4.Geometry,
    plane_orientation=plane_orienatation,
    approach_direction=approaching_vector,
    approach_distance=Slider(0.1, range=-0.95..1.2))  # -> out, placing_plane, approach_placing_plane; inputs plane: Plane
# ---------- ghpython_script_2: Python ----------
import Rhino.Geometry as rg

a = rg.Plane(plane.Origin, plane.XAxis, plane.YAxis)

b = rg.Plane(plane.Origin, - plane.XAxis, plane.YAxis)

c = rg.Plane(plane.Origin, a.ZAxis, a.YAxis)

d = rg.Plane(plane.Origin, b.ZAxis, b.YAxis)

if plane_orientation == 0:
    placing_plane = a
elif plane_orientation == 1:
    placing_plane = b
elif plane_orientation == 2:
    placing_plane = c
else:
    placing_plane = d
    
if approach_direction == 0:
    vec = placing_plane.ZAxis
elif approach_direction == 1:
    vec = placing_plane.XAxis
elif approach_direction == 2:
    vec = placing_plane.YAxis
elif approach_direction == 3:
    vec = rg.Vector3d.ZAxis
elif approach_direction == 4:
    vec = rg.Vector3d.XAxis
else:
    vec = rg.Vector3d.YAxis
    
vec.Unitize()
vec *= approach_distance
approach_placing_plane = rg.Plane(placing_plane.Origin, placing_plane.XAxis, placing_plane.YAxis)
approach_placing_plane.Translate(vec)
# ---------- end ghpython_script_2 ----------
approach_placing_plane = Plane(ghpython_script_2.approach_placing_plane)
placing_plane = Plane(ghpython_script_2.placing_plane)
inverse_kinematics_2 = InverseKinematics(robot=robot, plane=placing_plane)  # -> configuration; same code as inverse_kinematics
inverse_kinematics_3 = InverseKinematics(robot=robot, plane=approach_placing_plane)  # -> configuration; same code as inverse_kinematics

placing_plane_robota = Plane(placing_plane)
placeconfig_robota = Data(inverse_kinematics_3)
approach_placing_plane_robota = Plane(approach_placing_plane)

# ----
# Adjustment for different pick
number_slider_5 = Slider(45, range=0..100)
radians = Radians(Degrees=expr("-x", number_slider_5))
amplitude_3 = Amplitude(Vector=expr("-x", "1,-1,0"), Amplitude=multiplication)
mesh = Mesh(move_3.Geometry)
rotate = Rotate(Geometry=mesh, Angle=radians, Plane=PlaneXY(0, 0, 0))  # -> Geometry, Transform
move_7 = Move(Geometry=rotate.Geometry, Motion=amplitude_3)  # -> Geometry, Transform

robota_place_approach_config = Data(placeconfig_robota)
robot_2 = Data(robot)
constraints_from_target_configuration = ConstraintsFromTargetConfiguration(robot=robot_2, target_configuration=robota_place_approach_config)  # -> flatten(constraints)
#   port target_configuration: The target configuration.
#   port tolerance_above: The tolerances above the targeted joint value of each configurable joint, defining the upper bound in radians/meters to be achieved.
#   port tolerance_below: The tolerances below the targeted joint value of each configurable joint, defining the lower bound in radians/meters to be achieved.
#   port group: The planning group for which we specify the constraint. Defaults to the robot's main planning group.
#   port constraints: A list joint constraints in radians/meters.
# ---------- constraints_from_target_configuration: Python ----------
"""
Create joint constraints for each of the robot's configurable joints based on a given target configuration.

COMPAS FAB v0.27.0
"""
import math

from ghpythonlib.componentbase import executingcomponent as component


class ConstraintsFromTargetConfiguration(component):

    DEFAULT_TOLERANCE_METERS = .001
    DEFAULT_TOLERANCE_RADIANS = math.radians(1)

    def RunScript(self, robot, target_configuration, tolerance_above, tolerance_below, group):
        if robot and target_configuration:
            tolerance_above = tolerance_above or self._generate_default_tolerances(robot.get_configurable_joints(group))
            tolerance_below = tolerance_below or self._generate_default_tolerances(robot.get_configurable_joints(group))

            constraints = robot.constraints_from_configuration(
                configuration=target_configuration,
                tolerances_above=tolerance_above,
                tolerances_below=tolerance_below,
                group=group
            )

            return constraints

    def _generate_default_tolerances(self, joints):
        return [
            self.DEFAULT_TOLERANCE_METERS if j.is_scalable()
            else self.DEFAULT_TOLERANCE_RADIANS
            for j in joints
        ]
# ---------- end constraints_from_target_configuration ----------
plan_motion = PlanMotion(
    robot=robot_2,
    goal_constraints=constraints_from_target_configuration,
    start_configuration=pickapproach_config_robota,
    compute=Toggle(True))  # -> trajectory; inputs goal_constraints: list, attached_collision_meshes: list, path_constraints: list, compute: Boolean
#   port goal_constraints: The goal to be achieved, defined in a set of constraints. Constraints can be very specific, for example defining value domains for each joint, such that the goal configuration is included, or defining a volume in space, to which a specific robot link (e.g. the end-effector) is required to move to.
#   port start_configuration: The robot's full configuration, i.e. values for all configurable joints of the entire robot, at the starting position. Defaults to the all-zero configuration.
#   port group: The planning group used for calculation. Defaults to the robot's main planning group.
#   port attached_collision_meshes: A list of attached collision meshes to be included for planning.
#   port path_constraints: Optional constraints that can be imposed along the solution path. Note that path calculation won't work if the start_configuration violates these constraints. Defaults to None.
#   port planner_id: The name of the algorithm used for path planning. Defaults to 'RRTConnect'
#   port compute: If True, calculates a trajectory.
#   port trajectory: The calculated trajectory.
# ---------- plan_motion: Python ----------
"""
Calculate a motion path.

COMPAS FAB v0.27.0
"""
from ghpythonlib.componentbase import executingcomponent as component
from scriptcontext import sticky as st

from compas_fab.ghpython.components import create_id


class PlanMotion(component):
    def RunScript(self, robot, goal_constraints, start_configuration, group, attached_collision_meshes, path_constraints, planner_id, compute):

        key = create_id(self, 'trajectory')

        path_constraints = list(path_constraints) if path_constraints else None
        attached_collision_meshes = list(attached_collision_meshes) if attached_collision_meshes else None
        print attached_collision_meshes 
        planner_id = str(planner_id) if planner_id else 'RRTConnect'

        if robot and robot.client and robot.client.is_connected and start_configuration and goal_constraints and compute:
            st[key] = robot.plan_motion(goal_constraints,
                                        start_configuration=start_configuration,
                                        group=group,
                                        options=dict(
                                            attached_collision_meshes=attached_collision_meshes,
                                            path_constraints=path_constraints,
                                            planner_id=planner_id,
                                        ))
        trajectory = st.get(key, None)
        return trajectory
# ---------- end plan_motion ----------
trajectory_visualize = TrajectoryVisualize(robot=robot_2, trajectory=plan_motion)  # -> start_configuration, configurations, fraction, time, planes, P, V, A
#   port group: The planning group for which this trajectory was planned.
#   port trajectory: The calculated trajectory.
#   port start_configuration: The start configuration of the trajectory.
#   port configurations: The full configurations along the trajectory.
#   port fraction: Indicates the fraction of requested trajectory that was calculated, e.g. 1 means the full trajectory was found.
#   port time: The time which is needed to execute that trajectory at full speed.
#   port planes: The planes of the robot's end-effector.
#   port P: The positions along the trajectory
#   port V: The velocities along the trajectory
#   port A: The accelerations along the trajectory
# ---------- trajectory_visualize: Python ----------
"""
Visualizes a trajectory.

COMPAS FAB v0.27.0
"""
from compas_ghpython import draw_frame
from compas_ghpython import list_to_ghtree
from ghpythonlib.componentbase import executingcomponent as component


class TrajectoryVisualize(component):
    def RunScript(self, robot, group, trajectory):
        start_configuration = None
        configurations = []
        fraction = 0.
        time = 0.

        planes = []
        positions = []
        velocities = []
        accelerations = []

        if robot and trajectory:
            group = group or robot.main_group_name

            for c in trajectory.points:
                configurations.append(robot.merge_group_with_full_configuration(c, trajectory.start_configuration, group))
                frame = robot.forward_kinematics(c, group, options=dict(solver='model'))
                planes.append(draw_frame(frame))
                positions.append(c.positions)
                velocities.append(c.velocities)
                accelerations.append(c.accelerations)

            start_configuration = trajectory.start_configuration
            fraction = trajectory.fraction
            time = trajectory.time_from_start

        P = list_to_ghtree(list(zip(*positions)))
        V = list_to_ghtree(list(zip(*velocities)))
        A = list_to_ghtree(list(zip(*accelerations)))

        # return outputs if you have them; here I try it for you:
        return (start_configuration, configurations, fraction, time, planes, P, V, A)
# ---------- end trajectory_visualize ----------
robota_pick_approach_config = Data(pickapproach_config_robota)
robota_pickup_plane = Plane(move_5.Geometry)

panel_4 = Panel("""robotA_tool0
robotA_link_6""")
attached_collision_mesh = AttachedCollisionMesh(
    scene=scene,
    mesh=move_7.Geometry,
    identifier="test1",
    link_name="robotA_tool0",
    touch_links=panel_4,
    add=Toggle(False),
    remove=Button())  # -> attached_collision_mesh; inputs mesh: Mesh, touch_links: list, add: Boolean, remove: Boolean
#   port scene: The planning scene.
#   port mesh: A collision mesh.
#   port identifier: The identifier of the collision mesh.
#   port link_name: The robot's link name to attach the mesh to.
#   port touch_links: Names of links that the robot is allowed to touch.
#   port add: If True, adds the collision mesh to the planning scene.
#   port remove: If True, removes the collision mesh from the planning scene.
#   port attached_collision_mesh: A collision mesh that is attached to a robot's link.
# ---------- attached_collision_mesh: Python ----------
"""
Add an attached collision mesh to the robot.

COMPAS FAB v0.27.0
"""
from ghpythonlib.componentbase import executingcomponent as component

from compas_rhino.geometry import RhinoMesh
from compas_fab.robots import AttachedCollisionMesh
from compas_fab.robots import CollisionMesh


class AttachedCollisionMeshComponent(component):
    def RunScript(self, scene, mesh, identifier, link_name, touch_links, add, remove):
        attached_collision_mesh = None
        if scene and mesh and identifier and link_name:
            compas_mesh = RhinoMesh.from_geometry(mesh).to_compas()
            collision_mesh = CollisionMesh(compas_mesh, identifier)
            attached_collision_mesh = AttachedCollisionMesh(collision_mesh, link_name, touch_links)
            if add:
                scene.add_attached_collision_mesh(attached_collision_mesh)
            if remove:
                scene.remove_attached_collision_mesh(identifier)
                scene.remove_collision_mesh(identifier)
        print attached_collision_mesh.link_name
        return attached_collision_mesh
# ---------- end attached_collision_mesh ----------
custom_preview = CustomPreview(
    Geometry=move_7.Geometry,
    Material={diffuse=RGB(221, 160, 221), emission=RGB(66, 48, 66), shine=0.5, specular=RGB(255, 255, 255), transparency=0})
approach_placing_plane_robota_2 = Plane(approach_placing_plane_robota)
robota_approach_place_config = Data(placeconfig_robota)
robota_place_plane = Plane(placing_plane_robota)
concatenate = Concatenate(FragmentA="robotA_", FragmentB=number_slider_3)

# ----
# Export to Json
export = Button()
send = GhPythonScript(
    robot=ros_robot,
    approach_pickup_config=robota_pick_approach_config,
    approach_place_plane=approach_placing_plane_robota_2,
    pickup_plane=robota_pickup_plane,
    approach_place_config=robota_approach_place_config,
    place_plane=robota_place_plane,
    configurations_pick_to_place=trajectory_visualize.configurations,
    export=export,
    speed=Slider(100, range=0..100),
    file_name=concatenate)  # -> actions; inputs approach_place_plane: Plane, pickup_plane: Plane, configurations_pick_to_place: list
# ---------- send: Python ----------
from datetime import datetime as dt
import os
import compas
import sys
from compas_rhino import unload_modules
from compas_rhino.conversions import RhinoPlane, RhinoMesh
from compas.geometry import Scale, Frame
from compas_fab.robots import Robot
from compas_ghpython.utilities import ghtree_to_list
import compas_rrc as rrc
import time
from compas_rhino.conversions import plane_to_compas_frame
import Rhino.Geometry as rg
import math

HERE = ghenv.LocalScope.ghdoc.Path
DATA = os.path.abspath(os.path.join(HERE, '..', '..', 'data'))
now = dt.now().strftime("%Y%m%d_")
file_path = DATA + "/" + now + file_name + ".json"

path = DATA = os.path.abspath(os.path.join(HERE, '..', '..', 'python/undo'))
if path not in sys.path:
    sys.path.append(path)

scalefactor = 1000
S = Scale.from_factors([scalefactor] * 3)

unload_modules('production_data')
from production_data import Action, ProductionData

actions = []

scalefactor = 1000
S = Scale.from_factors([scalefactor] * 3)

# Set tool
actions.append(Action('SetTool', dict(tool_name='tool0'), action_id = 0))
# Set work object
actions.append(Action('SetWorkObject', dict(wobj_name='wobj0'), action_id = 1))
id = 1

id +=1
actions.append(Action('PrintText', dict(text='Pickup Element?'), action_id = id))
id +=1
actions.append(Action('Stop', dict(), action_id = id))

#open gripper
id +=1
actions.append(Action('SetDigital', dict(io_name = 'ABB_Scalable_IO_0_DO13', value = 0),action_id = id))
id +=1
actions.append(Action('SetDigital', dict(io_name = 'ABB_Scalable_IO_0_DO14', value = 1),action_id = id))

#send above pickup with configuration
joints = [math.degrees(j) for j in approach_pickup_config.joint_values]
id +=1
actions.append(Action('MoveToJoints', dict(joints = joints, ext_axes = [], speed=speed, zone= rrc.Zone.FINE, feedback_level=rrc.FeedbackLevel.DONE), action_id = id))

#send to pickup with plane
frame = plane_to_compas_frame(pickup_plane)
frame_rob = robot.from_tcf_to_t0cf([frame])[0]
scaled_frame = frame_rob.transformed(S)
id +=1
actions.append(Action('MoveToFrame', dict(frame= scaled_frame, speed=speed, zone=rrc.Zone.FINE, motion_type='rrc.Motion.LINEAR',feedback_level=rrc.FeedbackLevel.DONE), action_id = id))

#wait

id +=1
actions.append(Action('WaitTime', dict(time = 1,  feedback_level=rrc.FeedbackLevel.DONE), action_id = id))

#close
id +=1
actions.append(Action('SetDigital', dict(io_name = 'ABB_Scalable_IO_0_DO14', value = 0),action_id = id))
id +=1
actions.append(Action('SetDigital', dict(io_name = 'ABB_Scalable_IO_0_DO13', value = 1),action_id = id))

#config
#send above pickup with configuration
joints = [math.degrees(j) for j in approach_pickup_config.joint_values]
id +=1
actions.append(Action('MoveToJoints', dict(joints = joints, ext_axes = [], speed=speed, zone= 5, feedback_level=rrc.FeedbackLevel.DONE), action_id = id))

#trajectory from above pickup to normal to place
for configuration in configurations_pick_to_place:
    
    temp = []
    for n,j in zip(configuration.joint_names,configuration.joint_values):
        if n == "robotA_joint_1":
            temp.append(j)
    for n,j in zip(configuration.joint_names,configuration.joint_values):
        if n == "robotA_joint_2":
            temp.append(j)
    for n,j in zip(configuration.joint_names,configuration.joint_values):
        if n == "robotA_joint_3":
            temp.append(j)
    for n,j in zip(configuration.joint_names,configuration.joint_values):
        if n == "robotA_joint_4":
            temp.append(j)
    for n,j in zip(configuration.joint_names,configuration.joint_values):
        if n == "robotA_joint_5":
            temp.append(j)
    for n,j in zip(configuration.joint_names,configuration.joint_values):
        if n == "robotA_joint_6":
            temp.append(j)

    joints = [math.degrees(j) for j in temp]
    #print joints
    id +=1
    actions.append(Action('MoveToJoints', dict(joints = joints, ext_axes = [], speed=speed, zone= 5, feedback_level=rrc.FeedbackLevel.DONE), action_id = id))

#text
id +=1
actions.append(Action('PrintText', dict(text='RobotB goes to final position of element'), action_id = id))
id +=1
actions.append(Action('Stop', dict(), action_id = id))

#place with plane
frame = plane_to_compas_frame(place_plane)
frame_rob = robot.from_tcf_to_t0cf([frame])[0]
scaled_frame = frame_rob.transformed(S)
id +=1
actions.append(Action('MoveToFrame', dict(frame= scaled_frame, speed=speed, zone=rrc.Zone.FINE, motion_type='rrc.Motion.LINEAR',feedback_level=rrc.FeedbackLevel.DONE), action_id = id))

#can I leave?
id +=1
actions.append(Action('PrintText', dict(text='Release element?'), action_id = id))
id +=1
actions.append(Action('Stop', dict(), action_id = id))

#open gripper
id +=1
actions.append(Action('SetDigital', dict(io_name = 'ABB_Scalable_IO_0_DO13', value = 0),action_id = id))
id +=1
actions.append(Action('SetDigital', dict(io_name = 'ABB_Scalable_IO_0_DO14', value = 1),action_id = id))

#wait
id +=1
actions.append(Action('WaitTime', dict(time = 0.5,  feedback_level=rrc.FeedbackLevel.DONE), action_id = id))

#send to approach place plane
frame = plane_to_compas_frame(approach_place_plane)
frame_rob = robot.from_tcf_to_t0cf([frame])[0]
scaled_frame = frame_rob.transformed(S)
id +=1
actions.append(Action('MoveToFrame', dict(frame= scaled_frame, speed=speed, zone=rrc.Zone.FINE, motion_type='rrc.Motion.LINEAR',feedback_level=rrc.FeedbackLevel.DONE), action_id = id))

#send above pickup with configuration
id +=1
actions.append(Action('PrintText', dict(text='RobotB goes to pick element'), action_id = id))
id +=1
actions.append(Action('Stop', dict(), action_id = id))

#REVERSE?
for configuration in configurations_pick_to_place[::-1]:
    
    temp = []
    for n,j in zip(configuration.joint_names,configuration.joint_values):
        if n == "robotA_joint_1":
            temp.append(j)
    for n,j in zip(configuration.joint_names,configuration.joint_values):
        if n == "robotA_joint_2":
            temp.append(j)
    for n,j in zip(configuration.joint_names,configuration.joint_values):
        if n == "robotA_joint_3":
            temp.append(j)
    for n,j in zip(configuration.joint_names,configuration.joint_values):
        if n == "robotA_joint_4":
            temp.append(j)
    for n,j in zip(configuration.joint_names,configuration.joint_values):
        if n == "robotA_joint_5":
            temp.append(j)
    for n,j in zip(configuration.joint_names,configuration.joint_values):
        if n == "robotA_joint_6":
            temp.append(j)

    joints = [math.degrees(j) for j in temp]
    #print joints
    id +=1
    actions.append(Action('MoveToJoints', dict(joints = joints, ext_axes = [], speed=speed, zone= 5, feedback_level=rrc.FeedbackLevel.DONE), action_id = id))


production_data = ProductionData(actions)

if export:
    with open(file_path, 'w') as fp:
        compas.json_dump(production_data.to_data(), fp)
# ---------- end send ----------

list_item_4 = ListItem(List=trajectory_visualize.configurations, Index=0, Wrap=True)
ghpython_script_3 = GhPythonScript(robot=robot, config_a=inverse_kinematics_2, conf=list_item_4)  # -> out, a
# ---------- ghpython_script_3: Python ----------
config_A = robot.zero_configuration(group = "robotA")
config_A.joint_values = config_a.joint_values

config_B = robot.zero_configuration(group = "robotB")

join_values= []

for n,j in zip(conf.joint_names,conf.joint_values):
    if n == "robotB_joint_1":
        join_values.append(j)
for n,j in zip(conf.joint_names,conf.joint_values):
    if n == "robotB_joint_2":
        join_values.append(j)
for n,j in zip(conf.joint_names,conf.joint_values):
    if n == "robotB_joint_3":
        join_values.append(j)
for n,j in zip(conf.joint_names,conf.joint_values):
    if n == "robotB_joint_4":
        join_values.append(j)
for n,j in zip(conf.joint_names,conf.joint_values):
    if n == "robotB_joint_5":
        join_values.append(j)
for n,j in zip(conf.joint_names,conf.joint_values):
    if n == "robotB_joint_6":
        join_values.append(j)

config_B.joint_values = join_values
a = config_A.merged(config_B)
# ---------- end ghpython_script_3 ----------
merge = Merge(Data1=flatten(trajectory_visualize.configurations), Data2=flatten(ghpython_script_3.a))

unit_y_2 = UnitY(Factor=1)
amplitude_4 = Amplitude(Vector=unit_y_2, Amplitude=multiplication)

list_length_2 = ListLength(List=merge)
run = BooleanToggle(True)
python = PythonScript(Run=run, Target=list_length_2, Interval=Slider(25, range=1..1000))  # -> Counter; inputs Run: Boolean
# ---------- python: Python ----------
import Grasshopper as gh

def updateComponent(interval):
    
    """ Update this component similar to using a grasshopper timer """
    
    def callBack(e):
        ghenv.Component.ExpireSolution(False)
        
    ghenv.Component.OnPingDocument().ScheduleSolution(interval,
    gh.Kernel.GH_Document.GH_ScheduleDelegate(callBack))

Target = Target-1

# Instantiate or reset persistent counter variable
if "count" not in globals() or not Run:
    count = 0

# Update the variable and component
if Run:
    if count < Target:
        count +=1
        updateComponent(Interval)
    elif count == Target:
        count = 0

# Output counter
if count == 0:
    Counter = Target
else:
    Counter = count
# ---------- end python ----------
item = ListItem(List=merge, Index=python, Wrap=True)
move_8 = Move(Geometry=move_3.Geometry, Motion=expr("-x", amplitude_4))  # -> Geometry, Transform
panel_5 = Panel(python)
robot_visualize_2 = RobotVisualize(
    robot=ros_robot,
    acm=move_8.Geometry,
    group="robotA",
    configuration=item,
    show_frames=Toggle(False),
    show_end_effector_frame=Toggle(True),
    show_cm=Toggle(True),
    show_acm=Toggle(True),
    plane2Flange=subtraction)  # -> visual, collision, collision_meshes, attached_meshes, frames, base_frame, ee_frame; inputs acm: Mesh, show_visual: Boolean, show_collision: Boolean, show_frames: Boolean, show_base_frame: Boolean, show_end_effector_frame: Boolean, show_cm: Boolean, show_acm: Boolean
#   port group: The planning group used for end-effector and base visualization.
#   port configuration: The robot's full configuration.
#   port show_visual: Whether or not to show the robot's visual meshes.
#   port show_collision: Whether or not to show the robot's collision meshes.
#   port show_frames: Whether or not to show the robot's joint frames.
#   port show_base_frame: Whether or not to show the robot's base frame.
#   port show_end_effector_frame: Whether or not to show the robot's end-effector frame.
#   port show_cm: Whether or not to show the collision meshes (if any).
#   port show_acm: Whether or not to show the attached collision meshes (if any).
#   port visual: Rhino meshes of the robot's visual geometry (if any).
#   port collision: Rhino meshes of the robot's collision geometry (if any).
#   port collision_meshes: Rhino meshes of the scene's collision meshes (if any).
#   port attached_meshes: Rhino meshes of the scene's attached collision meshes (if any).
#   port frames: The robot's joint frames as Rhino planes (if any).
#   port base_frame: The robot's base frame as a Rhino plane (if any).
#   port ee_frame: The robot's end-effector frame as a Rhino plane (if any).
# ---------- robot_visualize_2: Python ----------
"""
Visualizes the robot.

COMPAS FAB v0.27.0
"""
from compas.artists import Artist
from compas.geometry import Frame
from compas.geometry import Transformation
from compas_fab.robots import PlanningScene
from ghpythonlib.componentbase import executingcomponent as component
from compas_fab.robots import AttachedCollisionMesh
import Rhino.Geometry as rg


class RobotVisualize(component):
    def RunScript(
        self,
        robot,
        acm,
        group,
        configuration,
        show_visual,
        show_collision,
        show_frames,
        show_base_frame,
        show_end_effector_frame,
        show_cm,
        show_acm,
        plane2Flange
    ):

        visual = None
        collision = None
        collision_meshes = None
        attached_meshes = None
        frames = None
        base_frame = None
        ee_frame = None

        if robot:
            show_visual = True if show_visual is None else show_visual
            show_cm = True if show_cm is None else show_cm
            show_acm = True if show_acm is None else show_acm
            configuration = configuration or robot.zero_configuration()

            robot.update(configuration, visual=show_visual, collision=show_collision)
            compas_frames = robot.transformed_frames(configuration, group)

            if show_visual:
                visual = robot.artist.draw_visual()

            if show_collision:
                collision = robot.artist.draw_collision()

            if show_base_frame:
                base_compas_frame = compas_frames[0]
                artist = Artist(base_compas_frame)
                base_frame = artist.draw()

            if show_end_effector_frame:
                ee_compas_frame = robot.forward_kinematics(
                    configuration, group, options=dict(solver="model")
                )
                artist = Artist(ee_compas_frame)
                ee_frame = artist.draw()

            if show_frames:
                frames = []
                for compas_frame in compas_frames[1:]:
                    artist = Artist(compas_frame)
                    frame = artist.draw()
                    frames.append(frame)

            if show_cm or show_acm:
                scene = PlanningScene(robot)
                scene = robot.client.get_planning_scene()

                collision_meshes = []
                attached_meshes = []

                if show_cm:
                    for co in scene.world.collision_objects:
                        header = co.header
                        frame_id = header.frame_id
                        cms = co.to_collision_meshes()

                        for cm in cms:
                            if cm.frame != Frame.worldXY():
                                t = Transformation.from_frame(cm.frame)
                                mesh = cm.mesh.transformed(t)
                            else:
                                mesh = cm.mesh

                            collision_meshes.append(Artist(mesh).draw())

                if show_acm:
                    trans = rg.Transform.PlaneToPlane(rg.Plane.WorldXY, ee_frame)
                    acm.Transform(trans)
                    vec = ee_frame.Normal
                    vec.Unitize()
                    vec *= plane2Flange
                    trans2 = rg.Transform.Translation(-vec)
                    acm.Transform(trans2)
        return (
            visual,
            collision,
            collision_meshes,
            acm,
            frames,
            base_frame,
            ee_frame,
        )
# ---------- end robot_visualize_2 ----------
mesh_2 = Mesh(robot_visualize_2.attached_meshes)
mesh_3 = Mesh(robot_visualize_2.collision_meshes)
