# Grasshopper definition 01_scanning.ghx (Grasshopper 1.0.7)
# plug-ins: Bifocals

geometry = Geometry([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])
number_slider = Slider(0.45, range=0..1)
number_slider_2 = Slider(3, range=0..100)
number_slider_3 = Slider(30, range=-25..100)
number_slider_4 = Slider(25, range=-25..100)
number_slider_5 = Slider(20, range=0..100)
negative = Negative(Value=number_slider_3)
negative_2 = Negative(Value=number_slider_5)

a1 = Slider(165, range=-360..360)
a2 = Slider(10, range=-360..360)
a4 = Slider(175, range=-360..360)
a5 = Slider(37, range=-360..360)
a3 = Slider(45, range=-360..360)
a6 = Slider(125, range=-360..360)

info = Info()  # -> info
#   port info: Environment info.
# ---------- info: Python ----------
"""
Displays information about the active COMPAS environment.
"""
import compas_bootstrapper
from ghpythonlib.componentbase import executingcomponent as component

import compas
import compas_fab


class CompasInfo(component):
    def RunScript(self):
        self.Message = 'COMPAS v{}'.format(compas.__version__)
        info = 'COMPAS Version: {}\nEnvironment: {}\nCOMPAS FAB Version:{}'
        return (info.format(compas.__version__, compas_bootstrapper.ENVIRONMENT_NAME,compas_fab.__version__))
# ---------- end info ----------

# ----
# Load Robot
connect = BooleanToggle(True)
ros_connect = ROSConnect(connect=connect)  # -> ros_client, is_connected; inputs port: Int32, connect: Boolean
#   port ip: The ip address ROS. Defaults to 127.0.0.1.
#   port port: The port of ROS. Defaults to 9090.
#   port connect: If True, connects to ROS. If False, disconnects from ROS. Defaults to False.
#   port ros_client: The ROS client.
#   port is_connected: True if connection established.
# ---------- ros_connect: Python ----------
"""
Connect or disconnect to ROS.

COMPAS FAB v0.27.0
"""
from ghpythonlib.componentbase import executingcomponent as component
from scriptcontext import sticky as st

from compas_fab.backends import RosClient
from compas_fab.ghpython.components import create_id


class ROSConnect(component):
    def RunScript(self, ip, port, connect):
        ros_client = None

        ip = ip or '127.0.0.1'
        port = port or 9090

        key = create_id(self, 'ros_client')
        ros_client = st.get(key, None)

        if ros_client:
            st[key].close()
        if connect:
            st[key] = RosClient(ip, port)
            st[key].run(5)

        ros_client = st.get(key, None)
        is_connected = ros_client.is_connected if ros_client else False
        return (ros_client, is_connected)
# ---------- end ros_connect ----------
load_robot = BooleanToggle(True)
ros_robot = ROSRobot(ros_client=ros_connect.ros_client, load=load_robot)  # -> robot; inputs load: Boolean
#   port ros_client: The ROS client.
#   port load: If True, loads the robot from ROS. Defaults to False.
# ---------- ros_robot: Python ----------
"""
Load robot directly from ROS.

COMPAS FAB v0.27.0
"""
from compas_ghpython.artists import RobotModelArtist
from ghpythonlib.componentbase import executingcomponent as component
from scriptcontext import sticky as st

from compas_fab.ghpython.components import create_id


class ROSRobot(component):
    def RunScript(self, ros_client, load):
        key = create_id(self, 'robot')

        if ros_client and ros_client.is_connected and load:
            # Load URDF from ROS
            st[key] = ros_client.load_robot(load_geometry=True, precision='12f')
            st[key].artist = RobotModelArtist(st[key].model)

        robot = st.get(key, None)
        if robot:  # client sometimes need to be restarted, without needing to reload geometry
            robot.client = ros_client
        return robot
# ---------- end ros_robot ----------

# ---- group: set config
# Configuration A
# Robot Display
# (No collision checking)
a1_2 = Slider(0, range=-360..360)
a2_2 = Slider(0, range=-360..360)
a4_2 = Slider(0, range=-360..360)
a5_2 = Slider(0, range=-360..360)
a3_2 = Slider(0, range=-360..360)
a6_2 = Slider(0, range=-360..360)
config = PythonScript(vals=[a1_2, a2_2, a3_2, a4_2, a5_2, a6_2])  # -> config; inputs vals: list
# ---------- config: Python ----------
import math
from compas.robots import Configuration

config = Configuration.from_revolute_values([math.radians(a) for a in vals])
print config
# ---------- end config ----------

# ----
# Package Version: COMPAS Version: 1.17.4
# COMPAS FAB Version:0.27.0
your_version = Panel(info)

transform_from_a_to_b = Transform({TransformCount=1, Name="Generic", m00=-0.9999221402, m01=0.008940106854, m02=-0.008043585664, m03=1.203030307, m10=-0.008941059074, m11=-0.9999566329, m12=-0.000125599696, m13=0.009879962486, m20=-0.008043122016, m21=-5.338143916e-05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})

a1_3 = Slider(149, range=-360..360)
a2_3 = Slider(-3, range=-360..360)
a4_3 = Slider(189, range=-360..360)
a5_3 = Slider(27, range=-360..360)
a3_3 = Slider(19, range=-360..360)
a6_3 = Slider(127, range=-360..360)
number_slider_6 = Slider(0.15, range=0..1)
config_2 = PythonScript(vals=[a1_3, a2_3, a3_3, a4_3, a5_3, a6_3])  # -> config; inputs vals: list; same code as config
pt = ConstructPoint(XCoordinate=0, YCoordinate=0, ZCoordinate=number_slider_6)
pt_2 = ConstructPoint(XCoordinate=0, YCoordinate=0, ZCoordinate=number_slider_6)

# ----
# Tool Attachment
refresh = Button()
planning_scene = GhPythonScript(robot=ros_robot, refresh=refresh)  # -> a
# ---------- planning_scene: Python ----------
from compas_fab.robots import PlanningScene

from compas.artists import Artist
from compas.geometry import Frame
from compas.geometry import Transformation


scene = PlanningScene(robot)

collision_meshes = []
attached_collision_meshes = []

configuration = robot.zero_configuration()
scene = robot.client.get_planning_scene()

for co in scene.world.collision_objects:
    header = co.header
    frame_id = header.frame_id
    cms = co.to_collision_meshes()

    for cm in cms:
        if cm.frame != Frame.worldXY():
            t = Transformation.from_frame(cm.frame)
            mesh = cm.mesh.transformed(t)
        else:
            mesh = cm.mesh

        collision_meshes.append(mesh)

    for aco in scene.robot_state.attached_collision_objects:
        for acm in aco.to_attached_collision_meshes():
            frame_id = aco.object["header"]["frame_id"]
            frame = robot.forward_kinematics(configuration, options=dict(link=frame_id))
            t = Transformation.from_frame(frame)

            # Local CM frame
            if (acm.collision_mesh.frame and acm.collision_mesh.frame != Frame.worldXY()):
                t = t * Transformation.from_frame(acm.collision_mesh.frame)

            mesh = acm.collision_mesh.mesh.transformed(t)

            attached_collision_meshes.append(mesh)

a = []
for cm in collision_meshes + attached_collision_meshes:
    a.append(Artist(cm).draw_mesh())
# ---------- end planning_scene ----------

xy_plane = XYPlane(Origin=pt)
rad = Radians(Degrees=Slider(45, range=0..100))
xy_plane_2 = XYPlane(Origin=pt_2)
rad_2 = Radians(Degrees=Slider(45, range=0..100))
_1 = Data(null)
_2 = Data(null)
_3 = Data(null)
prot = RotatePlane(Plane=xy_plane, Angle=rad)
prot_2 = RotatePlane(Plane=xy_plane_2, Angle=rad_2)
merge = Merge(Data1=_1, Data2=_2, Data3=_3)
brep = Brep(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)

# ----
# Tool
gripper_bounding_box_mesh = Mesh(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)
gripper_meshes = Mesh([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])
mjoin = MeshJoin(Meshes=gripper_meshes)
tool = AttachedTool(robot=ros_robot, visual_mesh=mjoin, collision_mesh=gripper_bounding_box_mesh, tcf_plane=prot, group="robotA")  # -> robot; inputs visual_mesh: Mesh, collision_mesh: Mesh
#   port visual_mesh: A visual mesh for the tool.
#   port collision_mesh: A collision mesh for the tool.
#   port tcf_plane: The frame of the tool in tool0 frame.
#   port group: The planning group to which the tool should be attached.
# ---------- tool: Python ----------
"""
Attach a tool to the robot.

COMPAS FAB v0.27.0
"""
from ghpythonlib.componentbase import executingcomponent as component
from compas_rhino.conversions import RhinoMesh
from compas_rhino.conversions import plane_to_compas_frame

from compas.geometry import Frame
from compas_fab.robots import Tool


class AttachToolComponent(component):
    def RunScript(self, robot, visual_mesh, collision_mesh, tcf_plane, group):
        if robot and robot.client and robot.client.is_connected and visual_mesh:
            if not collision_mesh:
                collision_mesh = visual_mesh

            c_visual_mesh = RhinoMesh.from_geometry(visual_mesh).to_compas()
            c_collision_mesh = RhinoMesh.from_geometry(collision_mesh).to_compas()

            if not tcf_plane:
                frame = Frame.worldXY()
            else:
                frame = plane_to_compas_frame(tcf_plane)
                print frame.quaternion
            tool = Tool(c_visual_mesh, frame, c_collision_mesh)

            robot.attach_tool(tool, group)

        return robot
# ---------- end tool ----------

mesh_join = MeshJoin(Meshes=brep)
ghpython_script = GhPythonScript()  # -> out, a; disabled
# ---------- ghpython_script: Python ----------
from compas.rpc import Proxy

#np = Proxy("numpy")
#an_array = np.array([[1, 2], [3, 5]])
#print(np.mean(an_array))
#np.stop_server()

sklearn = Proxy("sklearn")

sklearn.stop_server()
# ---------- end ghpython_script ----------
# Export to Json
# Export to Json
panel = Panel(merge)

robotb_target_config = Data("Grasshopper.Kernel.Types.GH_ObjectWrapper")
robotab_start_config = Data("Grasshopper.Kernel.Types.GH_ObjectWrapper")

subtraction = Subtraction(A=Slider(49, range=-25..180), B=number_slider_4)
division = Division(A=subtraction, B=Slider(2, range=0..100))
unit_y = UnitY(Factor=number_slider)
point = Point(Point(1.995625869, -0.5561272645, 0.4299180344))
series = Series(Start=number_slider_4, Step=division, Count=number_slider_2)
unit_z = UnitZ(Factor=1)  # -> expr("-x", UnitVector)
move = Move(Geometry=point, Motion=unit_y)  # -> Geometry, Transform
radians = Radians(Degrees=series)
construct_plane = ConstructPlane(Origin=move.Geometry, XAxis=unit_z, YAxis=Vector(0, 1, 0))
plane_origin = PlaneOrigin(Base=construct_plane, Origin=point)
rotate = Rotate(Geometry=construct_plane, Angle=radians, Plane=plane_origin)  # -> Geometry, Transform

subtraction_2 = Subtraction(A=number_slider_3, B=negative)
division_2 = Division(A=subtraction_2, B=number_slider_2)
unit_y_2 = UnitY(Factor=number_slider)
point_2 = Point(Point(1.995625869, -0.5561272645, 0.35))
series_2 = Series(Start=negative, Step=division_2, Count=number_slider_2)
unit_z_2 = UnitZ(Factor=1)  # -> expr("-x", UnitVector)
move_2 = Move(Geometry=point_2, Motion=unit_y_2)  # -> Geometry, Transform
radians_2 = Radians(Degrees=series_2)
construct_plane_2 = ConstructPlane(Origin=move_2.Geometry, XAxis=unit_z_2, YAxis=Vector(0, 1, 0))
config_3 = PythonScript(vals=[a1, a2, a3, a4, a5, a6])  # -> config; inputs vals: list; same code as config
plane_origin_2 = PlaneOrigin(Base=construct_plane_2, Origin=point_2)
rotate_2 = Rotate(Geometry=construct_plane_2, Angle=radians_2, Plane=plane_origin_2)  # -> Geometry, Transform

subtraction_3 = Subtraction(A=number_slider_5, B=negative_2)
unit_y_3 = UnitY(Factor=number_slider)
division_3 = Division(A=subtraction_3, B=number_slider_2)
point_3 = Point(Point(1.995625869, -0.5561272645, 0.2441479772))
a1_4 = Slider(175, range=-360..360)
a2_4 = Slider(45, range=-360..360)
a3_4 = Slider(30, range=-360..360)
a4_4 = Slider(175, range=-360..360)
a5_4 = Slider(75, range=-360..360)
a6_4 = Slider(100, range=-360..360)
series_3 = Series(Start=negative_2, Step=division_3, Count=number_slider_2)
unit_z_3 = UnitZ(Factor=1)  # -> expr("-x", UnitVector)
move_3 = Move(Geometry=point_3, Motion=unit_y_3)  # -> Geometry, Transform
radians_3 = Radians(Degrees=series_3)
construct_plane_3 = ConstructPlane(Origin=move_3.Geometry, XAxis=unit_z_3, YAxis=Vector(0, 1, 0))
config_4 = PythonScript(vals=[a1_4, a2_4, a3_4, a4_4, a5_4, a6_4])  # -> config; inputs vals: list; same code as config
plane_origin_3 = PlaneOrigin(Base=construct_plane_3, Origin=point_3)
rotate_3 = Rotate(Geometry=construct_plane_3, Angle=radians_3, Plane=plane_origin_3)  # -> Geometry, Transform

# ----
# Tool
gripper_bounding_box_mesh_2 = Mesh(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)
gripper_meshes_2 = Mesh([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])
mjoin_2 = MeshJoin(Meshes=gripper_meshes_2)

volume = Volume(Geometry=gripper_bounding_box_mesh_2)  # -> Volume, Centroid
scale = Scale(Geometry=gripper_bounding_box_mesh_2, Center=volume.Centroid, Factor=Slider(0.9, range=0..1))  # -> Geometry, Transform

tool_2 = AttachedTool(robot=tool, visual_mesh=mjoin_2, collision_mesh=scale.Geometry, tcf_plane=prot_2, group="robotB")  # -> robot; inputs visual_mesh: Mesh, collision_mesh: Mesh; same code as tool

robot = Data(tool_2)

constraints_from_target_configuration = ConstraintsFromTargetConfiguration(robot=robot, target_configuration=robotb_target_config, group="robotB")  # -> flatten(constraints)
#   port target_configuration: The target configuration.
#   port tolerance_above: The tolerances above the targeted joint value of each configurable joint, defining the upper bound in radians/meters to be achieved.
#   port tolerance_below: The tolerances below the targeted joint value of each configurable joint, defining the lower bound in radians/meters to be achieved.
#   port group: The planning group for which we specify the constraint. Defaults to the robot's main planning group.
#   port constraints: A list joint constraints in radians/meters.
# ---------- constraints_from_target_configuration: Python ----------
"""
Create joint constraints for each of the robot's configurable joints based on a given target configuration.

COMPAS FAB v0.27.0
"""
import math

from ghpythonlib.componentbase import executingcomponent as component


class ConstraintsFromTargetConfiguration(component):

    DEFAULT_TOLERANCE_METERS = .001
    DEFAULT_TOLERANCE_RADIANS = math.radians(1)

    def RunScript(self, robot, target_configuration, tolerance_above, tolerance_below, group):
        if robot and target_configuration:
            tolerance_above = tolerance_above or self._generate_default_tolerances(robot.get_configurable_joints(group))
            tolerance_below = tolerance_below or self._generate_default_tolerances(robot.get_configurable_joints(group))

            constraints = robot.constraints_from_configuration(
                configuration=target_configuration,
                tolerances_above=tolerance_above,
                tolerances_below=tolerance_below,
                group=group
            )

            return constraints

    def _generate_default_tolerances(self, joints):
        return [
            self.DEFAULT_TOLERANCE_METERS if j.is_scalable()
            else self.DEFAULT_TOLERANCE_RADIANS
            for j in joints
        ]
# ---------- end constraints_from_target_configuration ----------
plan_motion = PlanMotion(
    robot=robot,
    goal_constraints=constraints_from_target_configuration,
    start_configuration=robotab_start_config,
    group="robotB",
    compute=Toggle(True))  # -> trajectory; inputs goal_constraints: list, attached_collision_meshes: list, path_constraints: list, compute: Boolean
#   port goal_constraints: The goal to be achieved, defined in a set of constraints. Constraints can be very specific, for example defining value domains for each joint, such that the goal configuration is included, or defining a volume in space, to which a specific robot link (e.g. the end-effector) is required to move to.
#   port start_configuration: The robot's full configuration, i.e. values for all configurable joints of the entire robot, at the starting position. Defaults to the all-zero configuration.
#   port group: The planning group used for calculation. Defaults to the robot's main planning group.
#   port attached_collision_meshes: A list of attached collision meshes to be included for planning.
#   port path_constraints: Optional constraints that can be imposed along the solution path. Note that path calculation won't work if the start_configuration violates these constraints. Defaults to None.
#   port planner_id: The name of the algorithm used for path planning. Defaults to 'RRTConnect'
#   port compute: If True, calculates a trajectory.
#   port trajectory: The calculated trajectory.
# ---------- plan_motion: Python ----------
"""
Calculate a motion path.

COMPAS FAB v0.27.0
"""
from ghpythonlib.componentbase import executingcomponent as component
from scriptcontext import sticky as st

from compas_fab.ghpython.components import create_id


class PlanMotion(component):
    def RunScript(self, robot, goal_constraints, start_configuration, group, attached_collision_meshes, path_constraints, planner_id, compute):

        key = create_id(self, 'trajectory')

        path_constraints = list(path_constraints) if path_constraints else None
        attached_collision_meshes = list(attached_collision_meshes) if attached_collision_meshes else None
        planner_id = str(planner_id) if planner_id else 'RRTConnect'

        if robot and robot.client and robot.client.is_connected and start_configuration and goal_constraints and compute:
            st[key] = robot.plan_motion(goal_constraints,
                                        start_configuration=start_configuration,
                                        group=group,
                                        options=dict(
                                            attached_collision_meshes=attached_collision_meshes,
                                            path_constraints=path_constraints,
                                            planner_id=planner_id,
                                        ))
        trajectory = st.get(key, None)
        return trajectory
# ---------- end plan_motion ----------
trajectory_visualize = TrajectoryVisualize(robot=robot, group="robotB", trajectory=plan_motion)  # -> start_configuration, configurations, fraction, time, planes, P, V, A
#   port group: The planning group for which this trajectory was planned.
#   port trajectory: The calculated trajectory.
#   port start_configuration: The start configuration of the trajectory.
#   port configurations: The full configurations along the trajectory.
#   port fraction: Indicates the fraction of requested trajectory that was calculated, e.g. 1 means the full trajectory was found.
#   port time: The time which is needed to execute that trajectory at full speed.
#   port planes: The planes of the robot's end-effector.
#   port P: The positions along the trajectory
#   port V: The velocities along the trajectory
#   port A: The accelerations along the trajectory
# ---------- trajectory_visualize: Python ----------
"""
Visualizes a trajectory.

COMPAS FAB v0.27.0
"""
from compas_ghpython import draw_frame
from compas_ghpython import list_to_ghtree
from ghpythonlib.componentbase import executingcomponent as component


class TrajectoryVisualize(component):
    def RunScript(self, robot, group, trajectory):
        start_configuration = None
        configurations = []
        fraction = 0.
        time = 0.

        planes = []
        positions = []
        velocities = []
        accelerations = []

        if robot and trajectory:
            group = group or robot.main_group_name

            for c in trajectory.points:
                configurations.append(robot.merge_group_with_full_configuration(c, trajectory.start_configuration, group))
                frame = robot.forward_kinematics(c, group, options=dict(solver='model'))
                planes.append(draw_frame(frame))
                positions.append(c.positions)
                velocities.append(c.velocities)
                accelerations.append(c.accelerations)

            start_configuration = trajectory.start_configuration
            fraction = trajectory.fraction
            time = trajectory.time_from_start

        P = list_to_ghtree(list(zip(*positions)))
        V = list_to_ghtree(list(zip(*velocities)))
        A = list_to_ghtree(list(zip(*accelerations)))

        # return outputs if you have them; here I try it for you:
        return (start_configuration, configurations, fraction, time, planes, P, V, A)
# ---------- end trajectory_visualize ----------

merge_config = MergeConfig(robot=robot, config_a=config, config_b=config_4, group_A="robotA", group_B="robotB")  # -> config
#   port config_a: The configuration to use as base for the merge.
#   port config_b: The configuration used to merge into the base one.
#   port config: The merged configuration.
# ---------- merge_config: Python ----------
"""
Merge two configurations.

COMPAS FAB v0.24.0
"""
from ghpythonlib.componentbase import executingcomponent as component


class ConfigMerge(component):
    def RunScript(self, robot, config_a, config_b, group_A, group_B):

        if config_a and config_b:
            config_A = robot.zero_configuration(group = group_A)
            config_A.joint_values = config_a.joint_values
            config_B = robot.zero_configuration(group = group_B)
            config_B.joint_values = config_b.joint_values
            return config_A.merged(config_B)

        return None
# ---------- end merge_config ----------
inverse_kinematics = InverseKinematics(robot=robot, plane=rotate_3.Geometry, start_configuration=merge_config, group="robotB")  # -> configuration
#   port plane: The plane or frame to calculate the inverse kinematic for.
#   port start_configuration: If passed, calculates the inverse such that the joint positions differ the least from the start_configuration. Defaults to the zero configuration.
#   port group: The planning group used for calculation. Defaults to the robot's main planning group.
#   port configuration: The planning group's configuration.
# ---------- inverse_kinematics: Python ----------
"""
Calculate the robot's inverse kinematic for a given plane.

COMPAS FAB v0.27.0
"""
from compas_rhino.conversions import RhinoPlane
from ghpythonlib.componentbase import executingcomponent as component


class InverseKinematics(component):
    def RunScript(self, robot, plane, start_configuration, group):
        configuration = None
        if robot and robot.client and robot.client.is_connected and plane:
            frame = RhinoPlane.from_geometry(plane).to_compas_frame()
            configuration = robot.inverse_kinematics(frame, start_configuration, group)
        return configuration
# ---------- end inverse_kinematics ----------

merge_config_2 = MergeConfig(robot=robot, config_a=config, config_b=config_3, group_A="robotA", group_B="robotB")  # -> config; same code as merge_config
inverse_kinematics_2 = InverseKinematics(robot=robot, plane=rotate_2.Geometry, start_configuration=merge_config_2, group="robotB")  # -> configuration; same code as inverse_kinematics

merge_config_3 = MergeConfig(robot=robot, config_a=config, config_b=config_2, group_A="robotA", group_B="robotB")  # -> config; same code as merge_config
point_a_config_robob = Data(inverse_kinematics)
point_b_config_robob = Data(inverse_kinematics_2)
list_item = ListItem(List=point_b_config_robob, Index=0, Wrap=True)  # -> Item1, Item

merge_config_4 = MergeConfig(robot=robot, config_a=config, config_b=list_item.Item1, group_A="robotA", group_B="robotB")  # -> config; same code as merge_config
inverse_kinematics_3 = InverseKinematics(robot=robot, plane=rotate.Geometry, start_configuration=merge_config_4, group="robotB")  # -> configuration; same code as inverse_kinematics

point_b_config_robob_2 = Data(inverse_kinematics_3)
list_item_2 = ListItem(List=point_b_config_robob_2, Index=0, Wrap=True)  # -> Item, Item1, Item2
scene = PlanningScene(robot=tool_2)  # -> scene
#   port scene: A planning scene.
# ---------- scene: Python ----------
"""
Create a planning scene.

COMPAS FAB v0.27.0
"""
from ghpythonlib.componentbase import executingcomponent as component
from scriptcontext import sticky as st

from compas_fab.ghpython.components import create_id
from compas_fab.robots import PlanningScene


class PlanningSceneComponent(component):
    def RunScript(self, robot):
        key = create_id(self, 'planning_scene')
        if robot:
            st[key] = PlanningScene(robot)
        return st.get(key, None)
# ---------- end scene ----------
list_item_3 = ListItem(List=point_b_config_robob_2, Index=Slider(0, range=0..2), Wrap=True)
data = Data([point_a_config_robob, point_b_config_robob, point_b_config_robob_2])
cm = CollisionMesh(scene=scene, mesh=mesh_join, identifier="table", add=Toggle(True), append=Toggle(False), remove=Button())  # -> ok; inputs mesh: Mesh, add: Boolean, append: Boolean, remove: Boolean
#   port scene: The planning scene.
#   port mesh: A collision mesh.
#   port identifier: The identifier of the collision mesh.
#   port add: If True, adds the collision mesh to the planning scene.
#   port append: If True, appends the collision mesh to the planning scene.
#   port remove: If True, removes the collision mesh from the planning scene.
#   port ok: True if the operation was successfully performed.
# ---------- cm: Python ----------
"""
Add or remove a collision mesh from the planning scene.

COMPAS FAB v0.27.0
"""
from compas_rhino.geometry import RhinoMesh
from ghpythonlib.componentbase import executingcomponent as component

from compas_fab.robots import CollisionMesh


class CollisionMeshComponent(component):
    def RunScript(self, scene, M, name, add, append, remove):
        ok = False
        self.Message = ""

        if (add and append) or (append and remove) or (add and remove):
            self.Message = "Use only one operation at a time\n(add, append or remove)"
            raise Exception(self.Message)

        if scene and M and name:
            mesh = RhinoMesh.from_geometry(M).to_compas()
            collision_mesh = CollisionMesh(mesh, name)
            if add:
                scene.add_collision_mesh(collision_mesh)
                self.Message = "Added"
                ok = True
            if append:
                scene.append_collision_mesh(collision_mesh)
                self.Message = "Appended"
                ok = True
            if remove:
                scene.remove_collision_mesh(name)
                self.Message = "Removed"
                ok = True
        return ok
# ---------- end cm ----------
python = GhPythonScript(robot=tool_2)  # -> out, a
# ---------- python: Python ----------
print robot.attached_tools
# ---------- end python ----------

# ----
# Export to Json
export = Button()
send = GhPythonScript(
    robot=ros_robot,
    configurations_pointA=point_a_config_robob,
    configurations_pointB=point_b_config_robob,
    configurations_pointC=merge,
    export=export,
    speed=Slider(200, range=0..1000),
    file_name="scan")  # -> actions; inputs configurations_pointA: list, configurations_pointB: list, configurations_pointC: list
# ---------- send: Python ----------
from datetime import datetime as dt
import os
import compas
import sys
from compas_rhino import unload_modules
from compas_rhino.conversions import RhinoPlane, RhinoMesh
from compas.geometry import Scale, Frame
from compas_fab.robots import Robot
from compas_ghpython.utilities import ghtree_to_list
import compas_rrc as rrc
import time
from compas_rhino.conversions import plane_to_compas_frame
import Rhino.Geometry as rg
import math

HERE = ghenv.LocalScope.ghdoc.Path
DATA = os.path.abspath(os.path.join(HERE, '..', '..', 'data'))
now = dt.now().strftime("%Y%m%d_")
file_path = DATA + "/" + now + file_name + ".json"

path = DATA = os.path.abspath(os.path.join(HERE, '..', '..', 'python'))
if path not in sys.path:
    sys.path.append(path)

scalefactor = 1000
S = Scale.from_factors([scalefactor] * 3)

unload_modules('production_data')
from production_data import Action, ProductionData

actions = []

scalefactor = 1000
S = Scale.from_factors([scalefactor] * 3)

# Set tool
actions.append(Action('SetTool', dict(tool_name='tool0'), action_id = 0))
# Set work object
actions.append(Action('SetWorkObject', dict(wobj_name='wobj0'), action_id = 1))
id = 1

id +=1
actions.append(Action('PrintText', dict(text='Start Scanning Around PointA?'), action_id = id))
id +=1
actions.append(Action('Stop', dict(), action_id = id))


#pointA
for i,configuration in enumerate(configurations_pointA):
    
    temp = []
    for n,j in zip(configuration.joint_names,configuration.joint_values):
        if n == "robotB_joint_1":
            temp.append(j)
    for n,j in zip(configuration.joint_names,configuration.joint_values):
        if n == "robotB_joint_2":
            temp.append(j)
    for n,j in zip(configuration.joint_names,configuration.joint_values):
        if n == "robotB_joint_3":
            temp.append(j)
    for n,j in zip(configuration.joint_names,configuration.joint_values):
        if n == "robotB_joint_4":
            temp.append(j)
    for n,j in zip(configuration.joint_names,configuration.joint_values):
        if n == "robotB_joint_5":
            temp.append(j)
    for n,j in zip(configuration.joint_names,configuration.joint_values):
        if n == "robotB_joint_6":
            temp.append(j)

    joints = [math.degrees(j) for j in temp]
    #print joints
    id +=1
    actions.append(Action('MoveToJoints', dict(joints = joints, ext_axes = [], speed=speed, zone= 5, feedback_level=rrc.FeedbackLevel.DONE), action_id = id))
    
    #wait
    id +=1
    actions.append(Action('WaitTime', dict(time = 0.5,  feedback_level=rrc.FeedbackLevel.DONE), action_id = id))
    
    id +=1
    actions.append(Action('PrintText', dict(text='Position {} out of {}'.format(i+1, len(configurations_pointA) )), action_id = id))
    id +=1
    actions.append(Action('Stop', dict(), action_id = id))
    
    #wait
    id +=1
    actions.append(Action('WaitTime', dict(time = 0.1,  feedback_level=rrc.FeedbackLevel.DONE), action_id = id))

#pointB
for i,configuration in enumerate(configurations_pointB):
    
    temp = []
    for n,j in zip(configuration.joint_names,configuration.joint_values):
        if n == "robotB_joint_1":
            temp.append(j)
    for n,j in zip(configuration.joint_names,configuration.joint_values):
        if n == "robotB_joint_2":
            temp.append(j)
    for n,j in zip(configuration.joint_names,configuration.joint_values):
        if n == "robotB_joint_3":
            temp.append(j)
    for n,j in zip(configuration.joint_names,configuration.joint_values):
        if n == "robotB_joint_4":
            temp.append(j)
    for n,j in zip(configuration.joint_names,configuration.joint_values):
        if n == "robotB_joint_5":
            temp.append(j)
    for n,j in zip(configuration.joint_names,configuration.joint_values):
        if n == "robotB_joint_6":
            temp.append(j)

    joints = [math.degrees(j) for j in temp]
    #print joints
    id +=1
    actions.append(Action('MoveToJoints', dict(joints = joints, ext_axes = [], speed=speed, zone= 5, feedback_level=rrc.FeedbackLevel.DONE), action_id = id))
    
    #wait
    id +=1
    actions.append(Action('WaitTime', dict(time = 0.5,  feedback_level=rrc.FeedbackLevel.DONE), action_id = id))
    
    id +=1
    actions.append(Action('PrintText', dict(text='Position {} out of {}'.format(i+1, len(configurations_pointB) )), action_id = id))
    id +=1
    actions.append(Action('Stop', dict(), action_id = id))
    
    #wait
    id +=1
    actions.append(Action('WaitTime', dict(time = 0.1,  feedback_level=rrc.FeedbackLevel.DONE), action_id = id))
    
#pointC
for i,configuration in enumerate(configurations_pointC):
    
    temp = []
    for n,j in zip(configuration.joint_names,configuration.joint_values):
        if n == "robotB_joint_1":
            temp.append(j)
    for n,j in zip(configuration.joint_names,configuration.joint_values):
        if n == "robotB_joint_2":
            temp.append(j)
    for n,j in zip(configuration.joint_names,configuration.joint_values):
        if n == "robotB_joint_3":
            temp.append(j)
    for n,j in zip(configuration.joint_names,configuration.joint_values):
        if n == "robotB_joint_4":
            temp.append(j)
    for n,j in zip(configuration.joint_names,configuration.joint_values):
        if n == "robotB_joint_5":
            temp.append(j)
    for n,j in zip(configuration.joint_names,configuration.joint_values):
        if n == "robotB_joint_6":
            temp.append(j)

    joints = [math.degrees(j) for j in temp]
    #print joints
    id +=1
    actions.append(Action('MoveToJoints', dict(joints = joints, ext_axes = [], speed=speed, zone= 5, feedback_level=rrc.FeedbackLevel.DONE), action_id = id))
    
    #wait
    id +=1
    actions.append(Action('WaitTime', dict(time = 0.5,  feedback_level=rrc.FeedbackLevel.DONE), action_id = id))
    
    id +=1
    actions.append(Action('PrintText', dict(text='Position {} out of {}'.format(i+1, len(configurations_pointC) )), action_id = id))
    id +=1
    actions.append(Action('Stop', dict(), action_id = id))
    
    #wait
    id +=1
    actions.append(Action('WaitTime', dict(time = 0.1,  feedback_level=rrc.FeedbackLevel.DONE), action_id = id))

production_data = ProductionData(actions)

if export:
    with open(file_path, 'w') as fp:
        compas.json_dump(production_data.to_data(), fp)
# ---------- end send ----------

panel_2 = Panel(python.out)
robot_visualize = RobotVisualize(robot=ros_robot, configuration=list_item_3, show_end_effector_frame=Toggle(True))  # -> visual, collision, collision_meshes, attached_meshes, frames, base_frame, ee_frame; inputs show_visual: Boolean, show_collision: Boolean, show_frames: Boolean, show_base_frame: Boolean, show_end_effector_frame: Boolean, show_cm: Boolean, show_acm: Boolean
#   port group: The planning group used for end-effector and base visualization.
#   port configuration: The robot's full configuration.
#   port show_visual: Whether or not to show the robot's visual meshes.
#   port show_collision: Whether or not to show the robot's collision meshes.
#   port show_frames: Whether or not to show the robot's joint frames.
#   port show_base_frame: Whether or not to show the robot's base frame.
#   port show_end_effector_frame: Whether or not to show the robot's end-effector frame.
#   port show_cm: Whether or not to show the collision meshes (if any).
#   port show_acm: Whether or not to show the attached collision meshes (if any).
#   port visual: Rhino meshes of the robot's visual geometry (if any).
#   port collision: Rhino meshes of the robot's collision geometry (if any).
#   port collision_meshes: Rhino meshes of the scene's collision meshes (if any).
#   port attached_meshes: Rhino meshes of the scene's attached collision meshes (if any).
#   port frames: The robot's joint frames as Rhino planes (if any).
#   port base_frame: The robot's base frame as a Rhino plane (if any).
#   port ee_frame: The robot's end-effector frame as a Rhino plane (if any).
# ---------- robot_visualize: Python ----------
"""
Visualizes the robot.

COMPAS FAB v0.27.0
"""
from compas.artists import Artist
from compas.geometry import Frame
from compas.geometry import Transformation
from compas_fab.robots import PlanningScene
from ghpythonlib.componentbase import executingcomponent as component


class RobotVisualize(component):
    def RunScript(
        self,
        robot,
        group,
        configuration,
        show_visual,
        show_collision,
        show_frames,
        show_base_frame,
        show_end_effector_frame,
        show_cm,
        show_acm,
    ):

        visual = None
        collision = None
        collision_meshes = None
        attached_meshes = None
        frames = None
        base_frame = None
        ee_frame = None

        if robot:
            show_visual = True if show_visual is None else show_visual
            show_cm = True if show_cm is None else show_cm
            show_acm = True if show_acm is None else show_acm
            configuration = configuration or robot.zero_configuration()

            robot.update(configuration, visual=show_visual, collision=show_collision)
            compas_frames = robot.transformed_frames(configuration, group)

            if show_visual:
                visual = robot.artist.draw_visual()

            if show_collision:
                collision = robot.artist.draw_collision()

            if show_base_frame:
                base_compas_frame = compas_frames[0]
                artist = Artist(base_compas_frame)
                base_frame = artist.draw()

            if show_end_effector_frame:
                ee_compas_frame = robot.forward_kinematics(
                    configuration, group, options=dict(solver="model")
                )
                artist = Artist(ee_compas_frame)
                ee_frame = artist.draw()

            if show_frames:
                frames = []
                for compas_frame in compas_frames[1:]:
                    artist = Artist(compas_frame)
                    frame = artist.draw()
                    frames.append(frame)

            if show_cm or show_acm:
                scene = PlanningScene(robot)
                scene = robot.client.get_planning_scene()

                collision_meshes = []
                attached_meshes = []

                if show_cm:
                    for co in scene.world.collision_objects:
                        header = co.header
                        frame_id = header.frame_id
                        cms = co.to_collision_meshes()

                        for cm in cms:
                            if cm.frame != Frame.worldXY():
                                t = Transformation.from_frame(cm.frame)
                                mesh = cm.mesh.transformed(t)
                            else:
                                mesh = cm.mesh

                            collision_meshes.append(Artist(mesh).draw())

                if show_acm:
                    for aco in scene.robot_state.attached_collision_objects:
                        for acm in aco.to_attached_collision_meshes():
                            frame_id = aco.object["header"]["frame_id"]
                            frame = robot.forward_kinematics(
                                configuration, options=dict(link=frame_id)
                            )
                            t = Transformation.from_frame(frame)

                            # Local CM frame
                            if (
                                acm.collision_mesh.frame
                                and acm.collision_mesh.frame != Frame.worldXY()
                            ):
                                t = t * Transformation.from_frame(
                                    acm.collision_mesh.frame
                                )

                            mesh = acm.collision_mesh.mesh.transformed(t)

                            attached_meshes.append(Artist(mesh).draw())

        return (
            visual,
            collision,
            collision_meshes,
            attached_meshes,
            frames,
            base_frame,
            ee_frame,
        )
# ---------- end robot_visualize ----------
