# Grasshopper definition 02_import_v3.ghx (Grasshopper 1.0.7)

# ---- group: magenta_base_geometry
number_slider = Slider(0.035, range=0..0.1)
number_slider_2 = Slider(0.08, range=0..0.1)
ghpython_script = GhPythonScript(thickness=number_slider, section=number_slider_2, count_x=Slider(15, range=0..100), count_y=Slider(12, range=0..100))  # -> out, rectangles, outline, grid; inputs count_x: Int32, count_y: Int32
# ---------- ghpython_script: Python ----------
import Rhino.Geometry as rg

rectangles = []
grid = []

for x in range(count_x):
    for y in range(count_y):
        px = thickness + 2*thickness*x + section*x
        py = thickness + 2*thickness*y + section*y
        p = rg.Point3d(px,py,0)
        pl = rg.Plane.WorldXY
        pl.Origin = p
        rec = rg.Rectangle3d(pl, section,section)
        rectangles.append(rec)
        
        brep = rg.Brep.CreatePlanarBreps(rec.ToNurbsCurve())[0]
    
        # Calculate the AreaMassProperties of the brep
        area_mass_props = rg.AreaMassProperties.Compute(brep)
    
        # Extract the centroid
        centroid = area_mass_props.Centroid
        grid.append(centroid)
        
outline = rg.Rectangle3d(rg.Plane.WorldXY, px + section + thickness, py + section + thickness)
# ---------- end ghpython_script ----------
surface = Surface(flatten(ghpython_script.rectangles))
surface_2 = Surface(ghpython_script.outline)
solid_difference = SolidDifference(BrepsA=surface_2, BrepsB=surface)
unit_z = UnitZ(Factor=Slider(0.15, range=0..1))
surface_3 = Surface(solid_difference)
surface_4 = Surface(ghpython_script.outline)
move = Move(Geometry=surface_4, Motion=expr("-x", unit_z))  # -> Geometry, Transform
unit_z_2 = UnitZ(Factor=Slider(0.25, range=0..1))
extrude = Extrude(Base=surface_3, Direction=expr("-x", unit_z))
extrude_2 = Extrude(Base=move.Geometry, Direction=expr("-x", unit_z_2))
cap_holes = CapHoles(Brep=extrude)
cap_holes_2 = CapHoles(Brep=extrude_2)
solid_union = SolidUnion(Breps=[cap_holes, cap_holes_2])

# ----
panel = Panel("K:/.shortcut-targets-by-id/1IiGhZQRuFujGaxqXg4taUaPR55vt4fB7/DMS 2024/06_RobotFiles/txt/diffCheck.txt")
original_state_1 = Box([{Plane=PlaneYZ(0.1344, 0.2837333333, 0.1279997264), X=Domain(-0.012, 0.012), Y=Domain(-0.25, 0.25), Z=Domain(-0.012, 0.012)}, {Plane=PlaneYZ(0.07466666667, 0.3434666667, 0.1279995046), X=Domain(-0.012, 0.012), Y=Domain(-0.25, 0.25), Z=Domain(-0.012, 0.012)}, {Plane=Plane(origin=(0.07466666667, 0.3136, 0.13024064), x=(-0.7113629932, 0, 0.7028247946), y=(-0.7028247946, 0, -0.7113629932)), X=Domain(-0.012, 0.012), Y=Domain(-0.25, 0.25), Z=Domain(-0.012, 0.012)}])
original_state_2 = Box([{Plane=PlaneYZ(0.1941333333, 0.224, 0.1279998855), X=Domain(-0.012, 0.012), Y=Domain(-0.25, 0.25), Z=Domain(-0.012, 0.012)}, {Plane=PlaneYZ(0.07466666667, 0.3434666667, 0.1280003898), X=Domain(-0.012, 0.012), Y=Domain(-0.25, 0.25), Z=Domain(-0.012, 0.012)}, {Plane=PlaneYZ(0.1344, 0.2837333333, 0.1280001973), X=Domain(-0.012, 0.012), Y=Domain(-0.25, 0.25), Z=Domain(-0.012, 0.012)}, {Plane=Plane(origin=(0.1941333333, 0.2538666667, 0.1702689067), x=(0.8049174921, 0, -0.5933867464), y=(0.5933867464, 0, 0.8049174921)), X=Domain(-0.012, 0.012), Y=Domain(-0.25, 0.25), Z=Domain(-0.012, 0.012)}, {Plane=Plane(origin=(0.07466666667, 0.3136, 0.1418336), x=(-0.7024239868, 0, 0.7117587673), y=(-0.7117587673, 0, -0.7024239868)), X=Domain(-0.012, 0.012), Y=Domain(-0.25, 0.25), Z=Domain(-0.012, 0.012)}])
ghpython_script_2 = GhPythonScript(previous_state=original_state_1, new_state=original_state_2, tolerance=Slider(0.045, range=0..0.1))  # -> out, new_breps, next_state_updated; inputs previous_state: list of Brep, new_state: list of Brep
# ---------- ghpython_script_2: Python ----------
import Rhino.Geometry as rg

new_breps = []
    
for new_brep in new_state:
    is_new = True
    
    # Get the centroid of the new Brep
    new_centroid = rg.AreaMassProperties.Compute(new_brep).Centroid

    for prev_brep in previous_state:
        # Get the centroid of the previous Brep
        prev_centroid = rg.AreaMassProperties.Compute(prev_brep).Centroid
        
        # Calculate the distance between the centroids
        distance = prev_centroid.DistanceTo(new_centroid)
        
        # Check if within tolerance
        if distance <= tolerance:
            # Brep is considered the same (within tolerance)
            is_new = False
            break
    
    if is_new:
        new_breps.append(new_brep)
        
next_state_updated = previous_state + new_breps
# ---------- end ghpython_script_2 ----------
original_state_3 = Box([{Plane=PlaneYZ(0.0448, 0.3434666667, 0.1280002929), X=Domain(-0.012, 0.012), Y=Domain(-0.25, 0.25), Z=Domain(-0.012, 0.012)}, {Plane=PlaneYZ(0.2837333333, 0.1344, 0.1279995362), X=Domain(-0.012, 0.012), Y=Domain(-0.25, 0.25), Z=Domain(-0.012, 0.012)}, {Plane=PlaneYZ(0.1344, 0.2837333333, 0.1280000638), X=Domain(-0.012, 0.012), Y=Domain(-0.25, 0.25), Z=Domain(-0.012, 0.012)}, {Plane=PlaneYZ(0.1941333333, 0.224, 0.12800011), X=Domain(-0.012, 0.012), Y=Domain(-0.25, 0.25), Z=Domain(-0.012, 0.012)}, {Plane=Plane(origin=(0.07466666667, 0.3136, 0.13408608), x=(0.7054775739, 0, -0.7087322433), y=(-0.7087322433, 0, -0.7054775739)), X=Domain(-0.012, 0.012), Y=Domain(-0.25, 0.25), Z=Domain(-0.012, 0.012)}, {Plane=Plane(origin=(0.1642666667, 0.2538666667, 0.1295380267), x=(-0.8040819484, 0, 0.5945184776), y=(0.5945184776, 0, 0.8040819484)), X=Domain(-0.012, 0.012), Y=Domain(-0.25, 0.25), Z=Domain(-0.012, 0.012)}, {Plane=Plane(origin=(0.2538666667, 0.1642666667, 0.16971584), x=(0.8505944918, 0, -0.5258222234), y=(-0.5258222234, 0, -0.8505944918)), X=Domain(-0.012, 0.012), Y=Domain(-0.25, 0.25), Z=Domain(-0.012, 0.012)}])
ghpython_script_3 = GhPythonScript(previous_state=ghpython_script_2.next_state_updated, new_state=original_state_3, tolerance=Slider(0.045, range=0..0.1))  # -> out, new_breps, next_state_updated; inputs previous_state: list of Brep, new_state: list of Brep; same code as ghpython_script_2
ghpython_script_4 = GhPythonScript(file_path=panel, width=Slider(0.08, range=0..0.1))  # -> out, boxes, lines
# ---------- ghpython_script_4: Python ----------
import Rhino.Geometry as rg

with open(file_path, 'r') as file:
    txt_lines = file.readlines()

boxes = []
origin = []
x_axis = []
y_axis = []
length = []
lines = []

for line in txt_lines:
    if line.strip() and not line.startswith('----------'):
        parts = list(map(float, line.split()))
        if len(parts) == 6:
            p1 = rg.Point3d(*parts[:3])
            p2 = rg.Point3d(*parts[3:6])
            lines.append(rg.Line(p1,p2))
            length.append(p1.DistanceTo(p2))
            origin.append( 0.5 * (p1 + p2) )
            xaxis = p2 - p1
            x_axis.append(xaxis)
        elif len(parts) == 3:
            yaxis = rg.Vector3d(*parts[:])
            y_axis.append( yaxis )
            
for o,x,y,l in zip(origin,x_axis,y_axis,length):
    
    pl = rg.Plane(o, x, y)
    box = rg.Box(pl, 
        rg.Interval(-0.5*l,0.5*l),
        rg.Interval(-0.5*width,0.5*width), 
        rg.Interval(-0.5*width,0.5*width))
    boxes.append(box)
# ---------- end ghpython_script_4 ----------
state_1 = Box([{Plane=PlaneYZ(0.1344, 0.2837333333, 0.1279997264), X=Domain(-0.012, 0.012), Y=Domain(-0.25, 0.25), Z=Domain(-0.012, 0.012)}, {Plane=PlaneYZ(0.07466666667, 0.3434666667, 0.1279995046), X=Domain(-0.012, 0.012), Y=Domain(-0.25, 0.25), Z=Domain(-0.012, 0.012)}, {Plane=Plane(origin=(0.07466666667, 0.3136, 0.13024064), x=(-0.7113629932, 0, 0.7028247946), y=(-0.7028247946, 0, -0.7113629932)), X=Domain(-0.012, 0.012), Y=Domain(-0.25, 0.25), Z=Domain(-0.012, 0.012)}])
state_3_new_breps = Brep([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])
state_2_new_breps = Brep([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])
curve = Curve(ghpython_script_4.lines)
unit_z_3 = UnitZ(Factor="-0.5")
panel_2 = Panel(ghpython_script_4.boxes)
original_boxes = Box(ghpython_script_4.boxes)
move_2 = Move(Geometry=original_boxes, Motion=unit_z_3)  # -> Geometry, Transform
oriented_boxes = Brep(move_2.Geometry)
bounding_box = BoundingBox(Content=oriented_boxes, Plane=PlaneXY(0, 0, 0), UnionBox=True)  # -> Box, Box_2
deconstruct_brep = DeconstructBrep(Brep=bounding_box.Box)  # -> Faces, Edges, Vertices
list_item = ListItem(List=deconstruct_brep.Vertices, Index=0, Wrap=True)
vector_2pt = Vector2Pt(PointA=list_item, PointB="0,0,0", Unitize=False)  # -> Vector, Length
move_3 = Move(Geometry=oriented_boxes, Motion=vector_2pt.Vector)  # -> Geometry, Transform
deconstruct_brep_2 = DeconstructBrep(Brep=move_3.Geometry)  # -> Faces, Edges, Vertices
length = Length(Curve=deconstruct_brep_2.Edges)
area = Area(Geometry=ghpython_script.rectangles)  # -> Area, Centroid
area_2 = Area(Geometry=move_3.Geometry)  # -> Area, Centroid
sort_list = SortList(Keys=length, ValuesValuesA=deconstruct_brep_2.Edges)  # -> Keys, ValuesValuesA
list_item_2 = ListItem(List=sort_list.ValuesValuesA, Index="-1", Wrap=True)  # -> flatten(Item)
list_item_3 = ListItem(List=sort_list.ValuesValuesA, Index="6", Wrap=True)  # -> flatten(Item)
series = Series(Start=0, Step=1, Count=10)
construct_plane = ConstructPlane(Origin=area_2.Centroid, XAxis=list_item_3, YAxis=list_item_2)
move_4 = Move(Geometry=ghpython_script.grid, Motion=Vector(0, 0, 10))  # -> Geometry, Transform
length_2 = Length(Curve=list_item_2)
number_slider_3 = Slider(0.04, range=0..0.1)
addition = Addition(A=number_slider, B=number_slider_2, C=number_slider)
section = Data(number_slider_2)
number_slider_4 = Slider(0.14, range=0..1)
division = Division(A=section, B=addition)

# ---- group: snap to grid
ghpython_script_5 = GhPythonScript(input_plane=construct_plane, points=ghpython_script.grid, grid=ghpython_script.grid, sc_factor=division)  # -> out, a; inputs input_plane: Plane, points: list of Point3d, grid: list of Point3d
# ---------- ghpython_script_5: Python ----------
import Rhino.Geometry as rg
import math


new_grid = []

for pt in grid: 
    xform = rg.Transform.Scale(rg.Point3d(0,0,0), sc_factor)
    pt.Transform(xform)
    new_grid.append(pt)


#snap origin to grid
min_squared_distance = float("inf")
for i, point in enumerate(points):
    squared_distance = (point.X - input_plane.Origin.X) ** 2 + (point.Y - input_plane.Origin.Y) ** 2
    if squared_distance < min_squared_distance:
        min_squared_distance = squared_distance
        closest_point = new_grid[i]

input_plane.Origin = rg.Point3d(closest_point.X, closest_point.Y, input_plane.Origin.Z)

a = input_plane
# ---------- end ghpython_script_5 ----------

# ----
plane = Plane(ghpython_script_5.a)
division_2 = Division(A=Slider(0.055, range=0..0.1), B=Slider(4, range=0..10))
scale = Scale(Geometry=ghpython_script.grid, Center=Point(0, 0, 0), Factor=division)  # -> Geometry, Transform
center_box = CenterBox(Base=plane, X=number_slider_3, Y=expr("0.5*x", length_2), Z=number_slider_3)
addition_2 = Addition(A=number_slider_3, B=Slider(0.03, range=0..0.1))

# ---- group: Fix orientation
ghpython_script_6 = GhPythonScript(
    thickness=number_slider,
    planes=plane,
    threshold=Slider(31, range=0..100),
    lengths=length_2,
    grid=ghpython_script.grid,
    section=number_slider_2,
    sc_factor=division)  # -> out, vertical, Y, X, v_lengths, x_lengths, y_lengths, new_grid; inputs planes: list of Plane, lengths: list, grid: list of Point3d
# ---------- ghpython_script_6: Python ----------
import Rhino.Geometry as rg
import math

vertical = []
X = []
Y = []

v_lengths = []
x_lengths = []
y_lengths = []


new_grid = []

for pt in grid: 
    xform = rg.Transform.Scale(rg.Point3d(0,0,0), sc_factor)
    pt.Transform(xform)
    new_grid.append(pt)


#align elements with world_axes

for i,pl in enumerate(planes):
    
    #check if the longest side is close to worldZ or -WorldZ, so if it's aligned with z (vertical)
    if rg.Vector3d.VectorAngle(pl.YAxis, rg.Vector3d.ZAxis) < math.radians(threshold) or rg.Vector3d.VectorAngle(pl.YAxis, -rg.Vector3d.ZAxis)<math.radians(threshold):
        plane = rg.Plane.WorldYZ
        #fix so that they are flash to the ground
        plane.Origin = rg.Point3d(pl.Origin.X, pl.Origin.Y, lengths[i]/2)
        vertical.append(plane)
        v_lengths.append(lengths[i])
        
    #chech if the longest side is close to worldY or -WorldY (Y aligned - hor)
    elif rg.Vector3d.VectorAngle(pl.YAxis, rg.Vector3d.YAxis) < math.radians(threshold) or rg.Vector3d.VectorAngle(pl.YAxis, -rg.Vector3d.YAxis)<math.radians(threshold):
        #make all planes the same
        if rg.Vector3d.VectorAngle(pl.XAxis, rg.Vector3d.XAxis) < math.radians(threshold) or rg.Vector3d.VectorAngle(pl.XAxis, -rg.Vector3d.XAxis)<math.radians(threshold):
            pl.XAxis = pl.ZAxis
        #check if it's horizontal
        if rg.Vector3d.VectorAngle(pl.YAxis, rg.Vector3d.YAxis) < math.radians(10) or rg.Vector3d.VectorAngle(pl.YAxis, -rg.Vector3d.YAxis) < math.radians(10):
            origin = pl.Origin
            pl = rg.Plane.WorldXY
            pl.Origin = rg.Point3d(origin.X, origin.Y, (origin.Z //(section+ 2*thickness))* (section + 2*thickness) + 0.5 * section)
        else:
            #force x component to be 0
            xaxis = rg.Vector3d( 0, pl.XAxis.Y, pl.XAxis.Z)
            yaxis = rg.Vector3d( 0, pl.YAxis.Y, pl.YAxis.Z)
            pl = rg.Plane(pl.Origin, xaxis, yaxis)
        Y.append(pl)
        y_lengths.append(lengths[i])
        
    #chech if the longest side is close to worldX or -WorldX (X aligned - hor)
    else:
        #make all planes the same
        if rg.Vector3d.VectorAngle(pl.XAxis, rg.Vector3d.YAxis) < math.radians(threshold) or rg.Vector3d.VectorAngle(pl.XAxis, -rg.Vector3d.YAxis)<math.radians(threshold):
            pl.XAxis = pl.ZAxis
        #check if it's horizontal
        if rg.Vector3d.VectorAngle(pl.YAxis, rg.Vector3d.XAxis) < math.radians(10) or rg.Vector3d.VectorAngle(pl.YAxis, -rg.Vector3d.XAxis) < math.radians(10):
            origin = pl.Origin
            pl = rg.Plane.WorldXY
            pl.Rotate (math.radians(90), rg.Vector3d.ZAxis, pl.Origin)
            pl.Origin = rg.Point3d(origin.X, origin.Y, (origin.Z //(section+ 2*thickness))*(section + 2*thickness) + 0.5 * section)
        else:
            #force y component to be 0
            xaxis = rg.Vector3d( pl.XAxis.X, 0, pl.XAxis.Z)
            yaxis = rg.Vector3d( pl.YAxis.X, 0, pl.YAxis.Z)
            pl = rg.Plane(pl.Origin, xaxis, yaxis)
        X.append(pl)
        x_lengths.append(lengths[i])
# ---------- end ghpython_script_6 ----------

# ----
subtraction = Subtraction(A=addition_2, B=division_2)
thickness = Data(number_slider)
section_2 = Data(number_slider_2)
division_3 = Division(A=section_2, B=2)
division_4 = Division(A=number_slider_2, B=Slider(2, range=0..10))
merge = Merge(Data1=ghpython_script_6.v_lengths, Data2=ghpython_script_6.x_lengths, Data3=ghpython_script_6.y_lengths)
multiplication = Multiplication(A=thickness, B=2)
addition_3 = Addition(A=division_3, B=thickness)
center_box_2 = CenterBox(Base=ghpython_script_6.X, X=division_3, Y=expr("0.5*x", ghpython_script_6.x_lengths), Z=division_3)
center_box_3 = CenterBox(Base=ghpython_script_6.vertical, X=division_3, Y=expr("0.5*x", ghpython_script_6.v_lengths), Z=division_3)
center_box_4 = CenterBox(Base=ghpython_script_6.Y, X=division_3, Y=expr("0.5*x", ghpython_script_6.y_lengths), Z=division_3)
merge_2 = Merge(Data1=ghpython_script_6.vertical, Data2=ghpython_script_6.X, Data3=ghpython_script_6.Y)
number_slider_5 = Slider(3, range=0..10)
number_slider_6 = Slider(3.01, range=0..10)
panel_3 = Panel(merge_2)
merge_3 = Merge(Data1=ghpython_script_6.vertical, Data2=ghpython_script_6.Y, Data3=ghpython_script_6.X)
custom_preview = CustomPreview(Geometry=center_box_2, Material=ColourSwatch(SwatchColor=RGB(48, 255, 224)))
custom_preview_2 = CustomPreview(Geometry=center_box_3, Material=ColourSwatch(SwatchColor=RGB(255, 229, 0)))
custom_preview_3 = CustomPreview(Geometry=center_box_4, Material=ColourSwatch(SwatchColor=RGB(255, 48, 210)))
scale_2 = Scale(Geometry=ghpython_script_6.X, Center=Point(0, 0, 0), Factor=number_slider_6)  # -> Geometry, Transform
scale_3 = Scale(Geometry=ghpython_script_6.Y, Center=Point(0, 0, 0), Factor=number_slider_6)  # -> Geometry, Transform
scale_4 = Scale(Geometry=merge_3, Center=Point(0, 0, 0), Factor=number_slider_6)  # -> Geometry, Transform
plane_2 = Plane(merge_2)
center_box_5 = CenterBox(Base=scale_2.Geometry, X=division_3, Y=expr("0.5*x", ghpython_script_6.x_lengths), Z=division_3)
center_box_6 = CenterBox(Base=scale_3.Geometry, X=division_3, Y=expr("0.5*x", ghpython_script_6.y_lengths), Z=division_3)
number_slider_7 = Slider(0.24, range=0..1)
scale_5 = Scale(Geometry=ghpython_script_6.new_grid, Center=Point(0, 0, 0), Factor=number_slider_6)  # -> Geometry, Transform
multiplication_2 = Multiplication(A=division_3, B=Slider(200, range=0..1000))
division_5 = Division(A=Slider(24, range=0..100), B=multiplication_2)
number_slider_8 = Slider(0.024, range=0..0.1)
scale_6 = Scale(Geometry=merge_2, Center=Point(0, 0, 0), Factor=Slider(3, range=0..10))  # -> Geometry, Transform
scale_nu = ScaleNU(Geometry=merge_2, Plane=PlaneXY(0, 0, 0), ScaleX=division_5, ScaleY=division_5, ScaleZ=division_5)  # -> Geometry, Transform
length_3 = Number(merge)
scale_7 = Scale(Geometry=scale_nu.Geometry, Center=Point(0, 0, 0), Factor=Slider(0.1, range=0..0.1))  # -> Geometry, Transform
ghpython_script_7 = GhPythonScript(x=length_3)  # -> out, a
# ---------- ghpython_script_7: Python ----------
if x < 1.8:
    a = 5
else:
    a = 10
# ---------- end ghpython_script_7 ----------
center_box_7 = CenterBox(
    Base=scale_4.Geometry,
    X=expr("x/2", number_slider_7),
    Y=expr("0.5*x", ghpython_script_7.a),
    Z=expr("x/2", number_slider_7))
center_box_8 = CenterBox(
    Base=scale_7.Geometry,
    X=expr("0.5*x", number_slider_8),
    Y=expr("0.5*x", ghpython_script_7.a),
    Z=expr("0.5*x", number_slider_8))
center_box_9 = CenterBox(
    Base=scale_6.Geometry,
    X=expr("0.5*x", number_slider_8),
    Y=expr("0.5*x", ghpython_script_7.a),
    Z=expr("0.5*x", number_slider_8))
