# Grasshopper definition xx_test.ghx (Grasshopper 1.0.7)
# plug-ins: Bifocals

# Load Robot
info = Info()  # -> info
#   port info: Environment info.
# ---------- info: Python ----------
"""
Displays information about the active COMPAS environment.
"""
import compas_bootstrapper
from ghpythonlib.componentbase import executingcomponent as component

import compas
import compas_fab


class CompasInfo(component):
    def RunScript(self):
        self.Message = 'COMPAS v{}'.format(compas.__version__)
        info = 'COMPAS Version: {}\nEnvironment: {}\nCOMPAS FAB Version:{}'
        return (info.format(compas.__version__, compas_bootstrapper.ENVIRONMENT_NAME,compas_fab.__version__))
# ---------- end info ----------

# ----
# Tool Attachment
connect = BooleanToggle(True)
ros_connect = ROSConnect(connect=connect)  # -> ros_client, is_connected; inputs port: Int32, connect: Boolean
#   port ip: The ip address ROS. Defaults to 127.0.0.1.
#   port port: The port of ROS. Defaults to 9090.
#   port connect: If True, connects to ROS. If False, disconnects from ROS. Defaults to False.
#   port ros_client: The ROS client.
#   port is_connected: True if connection established.
# ---------- ros_connect: Python ----------
"""
Connect or disconnect to ROS.

COMPAS FAB v0.27.0
"""
from ghpythonlib.componentbase import executingcomponent as component
from scriptcontext import sticky as st

from compas_fab.backends import RosClient
from compas_fab.ghpython.components import create_id


class ROSConnect(component):
    def RunScript(self, ip, port, connect):
        ros_client = None

        ip = ip or '127.0.0.1'
        port = port or 9090

        key = create_id(self, 'ros_client')
        ros_client = st.get(key, None)

        if ros_client:
            st[key].close()
        if connect:
            st[key] = RosClient(ip, port)
            st[key].run(5)

        ros_client = st.get(key, None)
        is_connected = ros_client.is_connected if ros_client else False
        return (ros_client, is_connected)
# ---------- end ros_connect ----------
load_robot = BooleanToggle(True)
ros_robot = ROSRobot(ros_client=ros_connect.ros_client, load=load_robot)  # -> robot; inputs load: Boolean
#   port ros_client: The ROS client.
#   port load: If True, loads the robot from ROS. Defaults to False.
# ---------- ros_robot: Python ----------
"""
Load robot directly from ROS.

COMPAS FAB v0.27.0
"""
from compas_ghpython.artists import RobotModelArtist
from ghpythonlib.componentbase import executingcomponent as component
from scriptcontext import sticky as st

from compas_fab.ghpython.components import create_id


class ROSRobot(component):
    def RunScript(self, ros_client, load):
        key = create_id(self, 'robot')

        if ros_client and ros_client.is_connected and load:
            # Load URDF from ROS
            st[key] = ros_client.load_robot(load_geometry=True, precision='12f')
            st[key].artist = RobotModelArtist(st[key].model)

        robot = st.get(key, None)
        if robot:  # client sometimes need to be restarted, without needing to reload geometry
            robot.client = ros_client
        return robot
# ---------- end ros_robot ----------

# ----
# Tool Robot A
number_slider = Slider(0.153, range=0..1)
subtraction = Subtraction(A=number_slider, B=Slider(0.012, range=0..0.1))
pt = ConstructPoint(XCoordinate=0, YCoordinate=0, ZCoordinate=subtraction)
xy_plane = XYPlane(Origin=pt)
rad = Radians(Degrees=Slider(45, range=0..83))
gripper_bounding_box_mesh = Mesh(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)
gripper_meshes = Mesh([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])
prot = RotatePlane(Plane=xy_plane, Angle=rad)
mjoin = MeshJoin(Meshes=gripper_meshes)
tool = AttachedTool(robot=ros_robot, visual_mesh=mjoin, collision_mesh=gripper_bounding_box_mesh, tcf_plane=prot, group="robotA")  # -> robot; inputs visual_mesh: Mesh, collision_mesh: Mesh
#   port visual_mesh: A visual mesh for the tool.
#   port collision_mesh: A collision mesh for the tool.
#   port tcf_plane: The frame of the tool in tool0 frame.
#   port group: The planning group to which the tool should be attached.
# ---------- tool: Python ----------
"""
Attach a tool to the robot.

COMPAS FAB v0.27.0
"""
from ghpythonlib.componentbase import executingcomponent as component
from compas_rhino.conversions import RhinoMesh
from compas_rhino.conversions import plane_to_compas_frame

from compas.geometry import Frame
from compas_fab.robots import Tool


class AttachToolComponent(component):
    def RunScript(self, robot, visual_mesh, collision_mesh, tcf_plane, group):
        if robot and robot.client and robot.client.is_connected and visual_mesh:
            if not collision_mesh:
                collision_mesh = visual_mesh

            c_visual_mesh = RhinoMesh.from_geometry(visual_mesh).to_compas()
            c_collision_mesh = RhinoMesh.from_geometry(collision_mesh).to_compas()

            if not tcf_plane:
                frame = Frame.worldXY()
            else:
                frame = plane_to_compas_frame(tcf_plane)
                print frame.quaternion
            tool = Tool(c_visual_mesh, frame, c_collision_mesh)

            robot.attach_tool(tool, group)

        return robot
# ---------- end tool ----------

your_version = Panel(info)

# ----
# Tool Robot B
number_slider_2 = Slider(0.9, range=0..1)
volume = Volume(Geometry=gripper_bounding_box_mesh)  # -> Volume, Centroid
scale = Scale(Geometry=gripper_bounding_box_mesh, Center=volume.Centroid, Factor=number_slider_2)  # -> Geometry, Transform
tool_2 = AttachedTool(robot=tool, visual_mesh=mjoin, collision_mesh=scale.Geometry, tcf_plane=prot, group="robotB")  # -> robot; inputs visual_mesh: Mesh, collision_mesh: Mesh; same code as tool

robot = Data(tool_2)

# ---- group: Plane
# pickup plane
point = Point(Point(-0.95351, -0.00309, 0.04127))
plane_origin = PlaneOrigin(Base=Plane(origin=(-0.95351, -0.00309, 0.04127), x=(-1, 0, 0), y=(0, 1, 0)), Origin=point)

# ----
point_2 = Point(Point(0.610529989, -0.0678766463, 0.5561196681))

unit_z = UnitZ(Factor=Slider(0.12, range=0..1))

# ---- group: Point
# place plane
plane_origin_2 = PlaneOrigin(Base=Plane(origin=(0.610529989, -0.0678766463, 0.5080000083), x=(0, -1, 0), y=(0, 0, -1)), Origin=point_2)

# ----
unit_z_2 = UnitZ(Factor=Slider(0.1, range=0..0.1))
a1 = Slider(0, range=-360..360)
a2 = Slider(0, range=-360..360)
a3 = Slider(61, range=-360..360)
a4 = Slider(0, range=-360..360)
a5 = Slider(0, range=-360..360)
a6 = Slider(0, range=-360..360)
move = Move(Geometry=plane_origin_2, Motion=unit_z_2)  # -> Geometry, Transform
move_2 = Move(Geometry=plane_origin, Motion=unit_z)  # -> Geometry, Transform
pickup_approach_plane = Plane(move_2.Geometry)

approach_placing_plane = Plane(move.Geometry)

config = PythonScript(vals=[a1, a2, a3, a4, a5, a6])  # -> config; inputs vals: list
# ---------- config: Python ----------
import math
from compas.robots import Configuration

config = Configuration.from_revolute_values([math.radians(a) for a in vals])
print config
# ---------- end config ----------
inverse_kinematics = InverseKinematics(robot=robot, plane=pickup_approach_plane, group="robotA")  # -> configuration
#   port plane: The plane or frame to calculate the inverse kinematic for.
#   port start_configuration: If passed, calculates the inverse such that the joint positions differ the least from the start_configuration. Defaults to the zero configuration.
#   port group: The planning group used for calculation. Defaults to the robot's main planning group.
#   port configuration: The planning group's configuration.
# ---------- inverse_kinematics: Python ----------
"""
Calculate the robot's inverse kinematic for a given plane.

COMPAS FAB v0.27.0
"""
from compas_rhino.conversions import RhinoPlane
from ghpythonlib.componentbase import executingcomponent as component


class InverseKinematics(component):
    def RunScript(self, robot, plane, start_configuration, group):
        configuration = None
        if robot and robot.client and robot.client.is_connected and plane:
            frame = RhinoPlane.from_geometry(plane).to_compas_frame()
            configuration = robot.inverse_kinematics(frame, start_configuration, group)
        return configuration
# ---------- end inverse_kinematics ----------
inverse_kinematics_2 = InverseKinematics(robot=robot, plane=plane_origin_2, group="robotA")  # -> configuration; same code as inverse_kinematics
inverse_kinematics_3 = InverseKinematics(robot=robot, plane=approach_placing_plane, group="robotA")  # -> configuration; same code as inverse_kinematics

# ---- group: pickuptogether
robot_2 = Data(robot)
merge_config = MergeConfig(robot=robot_2, config_a=inverse_kinematics, config_b=config, group_A="robotA", group_B="robotB")  # -> config
#   port config_a: The configuration to use as base for the merge.
#   port config_b: The configuration used to merge into the base one.
#   port config: The merged configuration.
# ---------- merge_config: Python ----------
"""
Merge two configurations.

COMPAS FAB v0.24.0
"""
from ghpythonlib.componentbase import executingcomponent as component


class ConfigMerge(component):
    def RunScript(self, robot, config_a, config_b, group_A, group_B):

        if config_a and config_b:
            config_A = robot.zero_configuration(group = group_A)
            config_A.joint_values = config_a.joint_values
            config_B = robot.zero_configuration(group = group_B)
            config_B.joint_values = config_b.joint_values
            return config_A.merged(config_B)

        return None
# ---------- end merge_config ----------

# ----
robota_place_approach_config = Data(inverse_kinematics_3)
robot_3 = Data(robot)
constraints_from_target_configuration = ConstraintsFromTargetConfiguration(robot=robot_3, target_configuration=robota_place_approach_config, group="robotA")  # -> flatten(constraints)
#   port target_configuration: The target configuration.
#   port tolerance_above: The tolerances above the targeted joint value of each configurable joint, defining the upper bound in radians/meters to be achieved.
#   port tolerance_below: The tolerances below the targeted joint value of each configurable joint, defining the lower bound in radians/meters to be achieved.
#   port group: The planning group for which we specify the constraint. Defaults to the robot's main planning group.
#   port constraints: A list joint constraints in radians/meters.
# ---------- constraints_from_target_configuration: Python ----------
"""
Create joint constraints for each of the robot's configurable joints based on a given target configuration.

COMPAS FAB v0.27.0
"""
import math

from ghpythonlib.componentbase import executingcomponent as component


class ConstraintsFromTargetConfiguration(component):

    DEFAULT_TOLERANCE_METERS = .001
    DEFAULT_TOLERANCE_RADIANS = math.radians(1)

    def RunScript(self, robot, target_configuration, tolerance_above, tolerance_below, group):
        if robot and target_configuration:
            tolerance_above = tolerance_above or self._generate_default_tolerances(robot.get_configurable_joints(group))
            tolerance_below = tolerance_below or self._generate_default_tolerances(robot.get_configurable_joints(group))

            constraints = robot.constraints_from_configuration(
                configuration=target_configuration,
                tolerances_above=tolerance_above,
                tolerances_below=tolerance_below,
                group=group
            )

            return constraints

    def _generate_default_tolerances(self, joints):
        return [
            self.DEFAULT_TOLERANCE_METERS if j.is_scalable()
            else self.DEFAULT_TOLERANCE_RADIANS
            for j in joints
        ]
# ---------- end constraints_from_target_configuration ----------
plan_motion = PlanMotion(
    robot=robot_3,
    goal_constraints=constraints_from_target_configuration,
    start_configuration=merge_config,
    group="robotA",
    compute=Toggle(True))  # -> trajectory; inputs goal_constraints: list, attached_collision_meshes: list, path_constraints: list, compute: Boolean
#   port goal_constraints: The goal to be achieved, defined in a set of constraints. Constraints can be very specific, for example defining value domains for each joint, such that the goal configuration is included, or defining a volume in space, to which a specific robot link (e.g. the end-effector) is required to move to.
#   port start_configuration: The robot's full configuration, i.e. values for all configurable joints of the entire robot, at the starting position. Defaults to the all-zero configuration.
#   port group: The planning group used for calculation. Defaults to the robot's main planning group.
#   port attached_collision_meshes: A list of attached collision meshes to be included for planning.
#   port path_constraints: Optional constraints that can be imposed along the solution path. Note that path calculation won't work if the start_configuration violates these constraints. Defaults to None.
#   port planner_id: The name of the algorithm used for path planning. Defaults to 'RRTConnect'
#   port compute: If True, calculates a trajectory.
#   port trajectory: The calculated trajectory.
# ---------- plan_motion: Python ----------
"""
Calculate a motion path.

COMPAS FAB v0.27.0
"""
from ghpythonlib.componentbase import executingcomponent as component
from scriptcontext import sticky as st

from compas_fab.ghpython.components import create_id


class PlanMotion(component):
    def RunScript(self, robot, goal_constraints, start_configuration, group, attached_collision_meshes, path_constraints, planner_id, compute):

        key = create_id(self, 'trajectory')

        path_constraints = list(path_constraints) if path_constraints else None
        attached_collision_meshes = list(attached_collision_meshes) if attached_collision_meshes else None
        print attached_collision_meshes 
        planner_id = str(planner_id) if planner_id else 'RRTConnect'

        if robot and robot.client and robot.client.is_connected and start_configuration and goal_constraints and compute:
            st[key] = robot.plan_motion(goal_constraints,
                                        start_configuration=start_configuration,
                                        group=group,
                                        options=dict(
                                            attached_collision_meshes=attached_collision_meshes,
                                            path_constraints=path_constraints,
                                            planner_id=planner_id,
                                        ))
        trajectory = st.get(key, None)
        return trajectory
# ---------- end plan_motion ----------
trajectory_visualize = TrajectoryVisualize(robot=robot_3, group="robotA", trajectory=plan_motion)  # -> start_configuration, configurations, fraction, time, planes, P, V, A
#   port group: The planning group for which this trajectory was planned.
#   port trajectory: The calculated trajectory.
#   port start_configuration: The start configuration of the trajectory.
#   port configurations: The full configurations along the trajectory.
#   port fraction: Indicates the fraction of requested trajectory that was calculated, e.g. 1 means the full trajectory was found.
#   port time: The time which is needed to execute that trajectory at full speed.
#   port planes: The planes of the robot's end-effector.
#   port P: The positions along the trajectory
#   port V: The velocities along the trajectory
#   port A: The accelerations along the trajectory
# ---------- trajectory_visualize: Python ----------
"""
Visualizes a trajectory.

COMPAS FAB v0.27.0
"""
from compas_ghpython import draw_frame
from compas_ghpython import list_to_ghtree
from ghpythonlib.componentbase import executingcomponent as component


class TrajectoryVisualize(component):
    def RunScript(self, robot, group, trajectory):
        start_configuration = None
        configurations = []
        fraction = 0.
        time = 0.

        planes = []
        positions = []
        velocities = []
        accelerations = []

        if robot and trajectory:
            group = group or robot.main_group_name

            for c in trajectory.points:
                configurations.append(robot.merge_group_with_full_configuration(c, trajectory.start_configuration, group))
                frame = robot.forward_kinematics(c, group, options=dict(solver='model'))
                planes.append(draw_frame(frame))
                positions.append(c.positions)
                velocities.append(c.velocities)
                accelerations.append(c.accelerations)

            start_configuration = trajectory.start_configuration
            fraction = trajectory.fraction
            time = trajectory.time_from_start

        P = list_to_ghtree(list(zip(*positions)))
        V = list_to_ghtree(list(zip(*velocities)))
        A = list_to_ghtree(list(zip(*accelerations)))

        # return outputs if you have them; here I try it for you:
        return (start_configuration, configurations, fraction, time, planes, P, V, A)
# ---------- end trajectory_visualize ----------

list_item = ListItem(List=trajectory_visualize.configurations, Index=0, Wrap=True)
ghpython_script = GhPythonScript(robot=robot, config_a=inverse_kinematics_2, conf=list_item)  # -> out, a
# ---------- ghpython_script: Python ----------
config_A = robot.zero_configuration(group = "robotA")
config_A.joint_values = config_a.joint_values

config_B = robot.zero_configuration(group = "robotB")

join_values= []

for n,j in zip(conf.joint_names,conf.joint_values):
    if n == "robotB_joint_1":
        join_values.append(j)
for n,j in zip(conf.joint_names,conf.joint_values):
    if n == "robotB_joint_2":
        join_values.append(j)
for n,j in zip(conf.joint_names,conf.joint_values):
    if n == "robotB_joint_3":
        join_values.append(j)
for n,j in zip(conf.joint_names,conf.joint_values):
    if n == "robotB_joint_4":
        join_values.append(j)
for n,j in zip(conf.joint_names,conf.joint_values):
    if n == "robotB_joint_5":
        join_values.append(j)
for n,j in zip(conf.joint_names,conf.joint_values):
    if n == "robotB_joint_6":
        join_values.append(j)

config_B.joint_values = join_values
a = config_A.merged(config_B)
# ---------- end ghpython_script ----------
merge = Merge(Data1=flatten(trajectory_visualize.configurations), Data2=flatten(ghpython_script.a))
list_length = ListLength(List=merge)
run = BooleanToggle(True)
python = PythonScript(Run=run, Target=list_length, Interval=Slider(25, range=1..1000))  # -> Counter; inputs Run: Boolean
# ---------- python: Python ----------
import Grasshopper as gh

def updateComponent(interval):
    
    """ Update this component similar to using a grasshopper timer """
    
    def callBack(e):
        ghenv.Component.ExpireSolution(False)
        
    ghenv.Component.OnPingDocument().ScheduleSolution(interval,
    gh.Kernel.GH_Document.GH_ScheduleDelegate(callBack))

Target = Target-1

# Instantiate or reset persistent counter variable
if "count" not in globals() or not Run:
    count = 0

# Update the variable and component
if Run:
    if count < Target:
        count +=1
        updateComponent(Interval)
    elif count == Target:
        count = 0

# Output counter
if count == 0:
    Counter = Target
else:
    Counter = count
# ---------- end python ----------
item = ListItem(List=merge, Index=python, Wrap=True)
geometry = Geometry({Plane=PlaneXY(0, 0, 0.141), X=Domain(-0.012, 0.012), Y=Domain(-0.5, 0.5), Z=Domain(-0.012, 0.012)})
robot_visualize = RobotVisualize(
    robot=ros_robot,
    acm=geometry,
    group="robotA",
    configuration=item,
    show_frames=Toggle(False),
    show_end_effector_frame=Toggle(True),
    show_cm=Toggle(True),
    show_acm=Toggle(True),
    plane2Flange=subtraction)  # -> visual, collision, collision_meshes, attached_meshes, frames, base_frame, ee_frame; inputs acm: Mesh, show_visual: Boolean, show_collision: Boolean, show_frames: Boolean, show_base_frame: Boolean, show_end_effector_frame: Boolean, show_cm: Boolean, show_acm: Boolean
#   port group: The planning group used for end-effector and base visualization.
#   port configuration: The robot's full configuration.
#   port show_visual: Whether or not to show the robot's visual meshes.
#   port show_collision: Whether or not to show the robot's collision meshes.
#   port show_frames: Whether or not to show the robot's joint frames.
#   port show_base_frame: Whether or not to show the robot's base frame.
#   port show_end_effector_frame: Whether or not to show the robot's end-effector frame.
#   port show_cm: Whether or not to show the collision meshes (if any).
#   port show_acm: Whether or not to show the attached collision meshes (if any).
#   port visual: Rhino meshes of the robot's visual geometry (if any).
#   port collision: Rhino meshes of the robot's collision geometry (if any).
#   port collision_meshes: Rhino meshes of the scene's collision meshes (if any).
#   port attached_meshes: Rhino meshes of the scene's attached collision meshes (if any).
#   port frames: The robot's joint frames as Rhino planes (if any).
#   port base_frame: The robot's base frame as a Rhino plane (if any).
#   port ee_frame: The robot's end-effector frame as a Rhino plane (if any).
# ---------- robot_visualize: Python ----------
"""
Visualizes the robot.

COMPAS FAB v0.27.0
"""
from compas.artists import Artist
from compas.geometry import Frame
from compas.geometry import Transformation
from compas_fab.robots import PlanningScene
from ghpythonlib.componentbase import executingcomponent as component
from compas_fab.robots import AttachedCollisionMesh
import Rhino.Geometry as rg


class RobotVisualize(component):
    def RunScript(
        self,
        robot,
        acm,
        group,
        configuration,
        show_visual,
        show_collision,
        show_frames,
        show_base_frame,
        show_end_effector_frame,
        show_cm,
        show_acm,
        plane2Flange
    ):

        visual = None
        collision = None
        collision_meshes = None
        attached_meshes = None
        frames = None
        base_frame = None
        ee_frame = None

        if robot:
            show_visual = True if show_visual is None else show_visual
            show_cm = True if show_cm is None else show_cm
            show_acm = True if show_acm is None else show_acm
            configuration = configuration or robot.zero_configuration()

            robot.update(configuration, visual=show_visual, collision=show_collision)
            compas_frames = robot.transformed_frames(configuration, group)

            if show_visual:
                visual = robot.artist.draw_visual()

            if show_collision:
                collision = robot.artist.draw_collision()

            if show_base_frame:
                base_compas_frame = compas_frames[0]
                artist = Artist(base_compas_frame)
                base_frame = artist.draw()

            if show_end_effector_frame:
                ee_compas_frame = robot.forward_kinematics(
                    configuration, group, options=dict(solver="model")
                )
                artist = Artist(ee_compas_frame)
                ee_frame = artist.draw()

            if show_frames:
                frames = []
                for compas_frame in compas_frames[1:]:
                    artist = Artist(compas_frame)
                    frame = artist.draw()
                    frames.append(frame)

            if show_cm or show_acm:
                scene = PlanningScene(robot)
                scene = robot.client.get_planning_scene()

                collision_meshes = []
                attached_meshes = []

                if show_cm:
                    for co in scene.world.collision_objects:
                        header = co.header
                        frame_id = header.frame_id
                        cms = co.to_collision_meshes()

                        for cm in cms:
                            if cm.frame != Frame.worldXY():
                                t = Transformation.from_frame(cm.frame)
                                mesh = cm.mesh.transformed(t)
                            else:
                                mesh = cm.mesh

                            collision_meshes.append(Artist(mesh).draw())

                if show_acm:
                    trans = rg.Transform.PlaneToPlane(rg.Plane.WorldXY, ee_frame)
                    acm.Transform(trans)
                    vec = ee_frame.Normal
                    vec.Unitize()
                    vec *= plane2Flange
                    trans2 = rg.Transform.Translation(-vec)
                    acm.Transform(trans2)
        return (
            visual,
            collision,
            collision_meshes,
            acm,
            frames,
            base_frame,
            ee_frame,
        )
# ---------- end robot_visualize ----------
mesh = Mesh(robot_visualize.attached_meshes)
